# Grasshopper definition 006 - SKY CITY - FR - Clean.gh (Grasshopper 1.0.7)
# Copyright: 2014
# plug-ins: Human, Kangaroo Components

# ----
# COLORS
number_slider = Slider(6, range=1..500)
official_colors = GhPythonScript(
    HOUS=ColourSwatch(SwatchColor=RGB(107, 64, 91)),
    WORK=ColourSwatch(SwatchColor=RGB(235, 181, 19)),
    SOCI=ColourSwatch(SwatchColor=RGB(222, 29, 64)),
    SPOR=ColourSwatch(SwatchColor=RGB(242, 105, 41)),
    SHOP=ColourSwatch(SwatchColor=RGB(63, 161, 166)),
    CIVI=ColourSwatch(SwatchColor=RGB(191, 107, 78)),
    EDUC=ColourSwatch(SwatchColor=RGB(201, 201, 155)),
    RELI=ColourSwatch(SwatchColor=RGB(59, 54, 61)))  # -> B
# ---------- official_colors: Python ----------
B = [HOUS,	WORK,	SOCI,	SPOR,	SHOP,	CIVI,	EDUC,	RELI]
# ---------- end official_colors ----------
R = ColourSwatch(SwatchColor=RGB(52, 51, 61))
H = ColourSwatch(SwatchColor=RGB(6, 64, 63))
W = ColourSwatch(SwatchColor=RGB(166, 124, 0))
S = ColourSwatch(SwatchColor=RGB(176, 48, 71))
S_2 = ColourSwatch(SwatchColor=RGB(189, 77, 17))
S_3 = ColourSwatch(SwatchColor=RGB(25, 122, 128))
C = ColourSwatch(SwatchColor=RGB(107, 65, 51))
E = ColourSwatch(SwatchColor=RGB(128, 128, 98))
H_2 = ColourSwatch(SwatchColor=RGB(82, 42, 66))
H_3 = ColourSwatch(SwatchColor=RGB(102, 70, 89))
W_2 = ColourSwatch(SwatchColor=RGB(171, 141, 53))
S_4 = ColourSwatch(SwatchColor=RGB(191, 77, 98))
S_5 = ColourSwatch(SwatchColor=RGB(196, 97, 43))
S_6 = ColourSwatch(SwatchColor=RGB(66, 135, 129))
C_2 = ColourSwatch(SwatchColor=RGB(135, 86, 70))
E_2 = ColourSwatch(SwatchColor=RGB(135, 135, 89))
R_2 = ColourSwatch(SwatchColor=RGB(64, 63, 76))
render_mode_colors = GhPythonScript(HOUSE_ACTIVITY=H_2, SLEEP=H, WORK=W, SOCIALIZING=S, SPORTS=S_2, SHOPPING=S_3, CIVIC=C, EDUCATION=E, RELIGION=R)  # -> A
# ---------- render_mode_colors: Python ----------
A = [HOUSE_ACTIVITY,SLEEP,WORK,SOCIALIZING,SPORTS,SHOPPING,CIVIC,EDUCATION,RELIGION]
# ---------- end render_mode_colors ----------
min_size = GhPythonScript(
    HOUS=number_slider,
    WORK=Slider(20, range=1..500),
    SOCI=Slider(30, range=1..500),
    SPOR=Slider(40, range=1..500),
    SHOP=Slider(10, range=1..500),
    CIVI=Slider(25, range=1..500),
    EDUC=Slider(30, range=1..500),
    RELI=Slider(50, range=1..500))  # -> B; same code as official_colors
max_size = GhPythonScript(
    HOUS=Slider(20, range=1..500),
    WORK=Slider(150, range=1..500),
    SOCI=Slider(100, range=1..500),
    SPOR=Slider(100, range=1..500),
    SHOP=Slider(50, range=1..500),
    CIVI=Slider(100, range=1..500),
    EDUC=Slider(100, range=1..500),
    RELI=Slider(200, range=1..500))  # -> B
# ---------- max_size: Python ----------
B = [HOUS, 	WORK,	SOCI,	SPOR,	SHOP,	CIVI,	EDUC,	RELI]
# ---------- end max_size ----------
render_mode_colors_2 = GhPythonScript(HOUS=H_3, WORK=W_2, SOCI=S_4, SPOR=S_5, SHOP=S_6, CIVI=C_2, EDUC=E_2, RELI=R_2)  # -> B; same code as official_colors

folder_path = Panel("C:\Users\filip\Desktop\3Dmove input")

# ----
# PROBABILITIES
#   &  NAMES
panel = Panel("3Dmove_names.csv")
cluster = Cluster_4(folder_path=folder_path, file=panel, names_separator=",", file_2="3Dmove_probability.csv", rules_separator=";")  # -> first_names_2, second_names_2, rules

# ----
# USER INPUT
number_slider_2 = Slider(10, range=1..20)
first_names = Panel("""Carla
Willy
Jane
Jon
Amou
Nougu
Carl
Kal
Xaby
Verry
Manny""")
archetype_csv_reader = GhPythonScript(directory=folder_path, num_of_arche=number_slider_2)  # -> activities, data
# ---------- archetype_csv_reader: Python ----------
__author__ = "Sangkyun Kim"
__version__ = "2018.12.22"

import os
import csv 

# Input
fdir = str(directory)
num_of_arche = int(num_of_arche)

# define class and methods

class ReadCSV:
    def __init__(self, fdir, num ):
        # attributes
        self.archetype = "archetype_{:02}".format(num)
        
        # data file path
        self.path = self.__get_file_path__(num)
        
        # read data
        self.data = self.__read_csv__(self.path)
        self.prob_start = self.data[0]
        self.prob_dur = self.data[1]
        
        # regroup data lists
        self.prob_start = self.__regroup__(self.prob_start)
        self.prob_dur = self.__regroup__(self.prob_dur)
    
    def __get_file_path__(self, num):
        f_name = "new_archetype_{:02}.csv".format(num)
        f_path = os.path.join(fdir, f_name)
        return f_path
    
    def __read_csv__(self, fdir):
        try:
            csv_file = open(self.path, 'r')
            csv_read = csv.reader(csv_file, delimiter=';', quoting=csv.QUOTE_NONNUMERIC)
            prob_start = []
            prob_dur = []
            count = 0
            for row in csv_read:
                if count < 13: prob_start.append(row)
                else : prob_dur.append(row)
                count += 1
            csv_file.close()
            data = [ prob_start, prob_dur ]
            return data
        except: print("*** Error @ __read_csv__ : unable to read")
    
    def __regroup__(self,prob):
        new_list = []
        for act in prob:
            sub_list = [ act[0], act[1:] ] 
            new_list.append(sub_list)
        return new_list


# Execute
data = []
for i in range(num_of_arche):
    data.append( ReadCSV(fdir, i) )

activities = []
for i in range( len( data[0].prob_start) ):
    activities.append( data[0].prob_start[i][0] )

# Output
activities
data
# ---------- end archetype_csv_reader ----------
last_names = Panel("""Cloud
Storm
Thunder
Lightening
Sun
Moon
Star
Hail
Rain
Snow
Sky
Fog
Arc-en-Ciel
aurora""")

R_3 = ColourSwatch(SwatchColor=RGB(87, 87, 87))
H_4 = ColourSwatch(SwatchColor=RGB(125, 100, 115))
H_5 = ColourSwatch(SwatchColor=RGB(87, 105, 104))
W_3 = ColourSwatch(SwatchColor=RGB(168, 149, 93))
S_7 = ColourSwatch(SwatchColor=RGB(171, 114, 126))
S_8 = ColourSwatch(SwatchColor=RGB(150, 120, 104))
S_9 = ColourSwatch(SwatchColor=RGB(121, 163, 166))
C_3 = ColourSwatch(SwatchColor=RGB(102, 79, 71))
E_3 = ColourSwatch(SwatchColor=RGB(130, 130, 116))
render_mode_colors_3 = GhPythonScript(
    HOUSE_ACTIVITY=H_4,
    SLEEP=H_5,
    WORK=W_3,
    SOCIALIZING=S_7,
    SPORTS=S_8,
    SHOPPING=S_9,
    CIVIC=C_3,
    EDUCATION=E_3,
    RELIGION=R_3)  # -> A; same code as render_mode_colors

# ----
# True : one archetype only
# False : all archetypes
archetype_choice = Slider(4, range=0..9)
one_archetype = BooleanToggle(False)
population = Slider(10, range=0..5000)
make_people = GhPythonScript(
    archetype_choice=archetype_choice,
    archetypes=one_archetype,
    population=population,
    data=archetype_csv_reader.data,
    first_names=first_names,
    last_names=last_names)  # -> flatten(people); inputs archetypes: Boolean, first_names: list, last_names: list
# ---------- make_people: Python ----------
__author__ = "Sangkyun Kim"
__version__ = "2018.12.22"
############################################################
#  Creating people : START
############################################################

import rhinoscriptsyntax as rs
import random as r
import math


# inputs

archetypes
archetype_choice = 'archetype_{:02}'.format(int(archetype_choice))
data # list of class instances
first_names
last_names
print last_names
# global variables
archetype = data.archetype

if archetypes == True :
    population = int( population )
else :
    demographics = {
    'archetype_00' : 2.8,
    'archetype_01' : 8.7,
    'archetype_02' : 20.4,
    'archetype_03' : 7.9,
    'archetype_04' : 3.9,
    'archetype_05' : 16.9,
    'archetype_06' : 13,
    'archetype_07' : 8.2,
    'archetype_08' : 9.4,
    'archetype_09' : 8.7,
    }
    population = int( demographics[archetype] * population / 100 )

len_of_list = len(data.prob_start)
act_prob = data.prob_start
dur_prob = data.prob_dur


#SET Vector class
class Vector(object):
    def __init__(self, *args):
        # Create a vector, example: v = Vector(1,2,3) 
        if len(args) == 0: self.values = (0,0,0)
        elif len(args) == 1:
            if type(args) is tuple: 
                t = args[0]
                self.values = (t[0], t[1], t[2])
            elif type(args) is list: 
                self.values = args
        else: self.values = tuple(args)
        
        self.x = self.values[0]
        self.y = self.values[1]
        self.z = self.values[2]

    def __add__(self, other):
        # Returns the vector addition of self and other 
        added = tuple( a + b for a, b in zip(self, other) )
        return Vector(added)

    def __sub__(self, other):
        # Returns the vector difference of self and other 
        subbed = tuple( a - b for a, b in zip(self, other) )
        return Vector(subbed)

    def __mul__(self, other):
        if type(other) == type(self):
            return self.dot(other)
        elif type(other) == type(1) or type(other) == type(1.0):
            product = tuple( a * other for a in self )
            return Vector(product)

    def __div__(self, other):
        if type(other) == type(1) or type(other) == type(1.0):
            divided = tuple( a / other for a in self )
            return Vector(divided)

    def mag(self):
        # Returns the magnitude of the vector 
        return math.sqrt( abs( sum(comp**2 for comp in self) ) )

    def unit(self):
        mag = self.mag()
        if mag > 0 : unitized = tuple( comp/mag for comp in self )
        else : unitized = (0,0,0)
        return Vector(unitized)

    def limit(self, max_force):
        limited = self.unit()
        limited = self.__mul__(max_force)
        return Vector(limited)
        
    def speed_limit(self, max_speed):
        if self.mag() > max_speed: vel = self.unit() * max_speed
        else : vel = self
        return Vector(vel)

    def cross(self, other):
        x = self.y * other.z - self.z * other.y
        y = self.z * other.x - self.x * other.z
        z = self.z * other.y - self.y * other.x
        product = ( x, y, z )
        print product
        return Vector(product)

    def dot(self, other):
        # Returns the dot product (inner product) of self and other vector
        return sum(a * b for a, b in zip(self, other))

    def distance(self, target):
        # Return the distance between the target and the current position
        vec = self.__sub__(target)
        distance = vec.mag()
        return distance

    def __iter__(self):
        return self.values.__iter__()
    
    def __len__(self):
        return len(self.values)
    
    def __getitem__(self, key):
        return self.values[key]
        
    def __repr__(self):
        return str(self.values)

# classes & functions
class MakePerson:
    def __init__(self, archetype, person_number):
    #SET attributes
        self.id = "{0}_{1:03}".format(archetype,person_number)
        self.archetype = archetype
        self.first_name = r.choice(first_names)
        self.last_name = r.choice(last_names)
        self.name = '{} {}'.format(self.first_name, self.last_name) 
        greetings = ['Hi, SkyCity !', 'Ha-nerl Ma-erl, An-nyong !', 'Salut, CielVille !', 'Ciao, CieloCitta !', 'Hallo, HimmelStadt !', 'Hallo, HemelStad !', 'Szia, EgVaros !', 'Hallo, HimmelBy !', 'Hej. HimmelStad !']
        self.greeting = r.choice(greetings)

    #SET behaviours
        self.behaviour_physic = 'physical behaviour'
        self.behaviour_social = 'social behaviour'

    #SET colour
        self.colour = None

    #SET current status 
        self.current_activity= 'current_activity not assigned'
        self.current_position = (0,0,0)
     
    #SET next status
        self.next_activity = 'next_activity not assigned'
        self.next_destination = (0,0,0)

    #SET schedule - activities
        self._create_time_slots()
        self.schedule_activities = self._create_activity_schedule()
        self.schedule_activities = self.fix_activity_schedule()

    #SET home
        self.core = 'please assign the centre point of the core'

    #SET initial movement attributes
        self.mass = 1
        self.halo = 2

        self.max_speed = 15
        self.min_speed = .5

        self.acc_force = 1
        self.max_force = 1
        
        # steer : attraction
        self.force_attr_to_core = 1
        self.force_attr = 1

        # steer : avoid
        self.force_avoid = 1
        
        # gravity
        gravity_force = (0,0,-0.1)
        gravity_force = Vector(gravity_force)
        self.gravity =  gravity_force.__mul__(self.mass) 

        # steer 
        self.direction = None
        self.steer = None

        self.steer_avoid = None

        self.travel_time = 0

        # GET target arrival zone
        self.arrival_zone = 5 # link to object        # INPUT
        self.arrived = 2

    def __repr__(self):
        return '{self.id}'.format(self=self)

    # METHODS
    # SCHEDULE
    def _create_time_slots(self):
        unit_time = 15
        #SET empty time slots
        self.time_slots = []
        num_of_slots = 24 * ( 60 / unit_time )
        for i in range( int( num_of_slots ) ):
            self.time_slots.append(None)
        return self.time_slots

    def _create_activity_schedule(self):
        time_slots = self.time_slots
        self.schedule_activities = []
        previous_activity = None
        for slot_num in range( len(time_slots) ):

            this_slot = time_slots[slot_num]         
            if this_slot == None:
                stop = 0
                while stop < 600:
                    choice_activity = r.randint(1,110)
                    choice_duration = r.randint(1,110)
                    range_choice_act = list(range(110))
                    range_choice_dur = list(range(110))
                    
                    for activity_num in range( len_of_list ):
                        activity = act_prob[activity_num]
                        # Check : the activity with the previous actiivty
                        if activity[0] == previous_activity : pass
                        else :
                            # Get probability of this activity
                            prob_this_act = activity[1][slot_num] 
                            list_of_probs = []
                            for chance_act in range( int(prob_this_act) ):
                                list_of_probs.append( range_choice_act.pop() )
                            # Check : choice and probability match
                            if choice_activity not in list_of_probs : pass
                            else :
                                for time_used in range( 96 ):
                                    prob_this_act_dur = dur_prob[activity_num][1][time_used]
                                    list_of_probs_dur = []
        
                                    for chance_dur in range( int(prob_this_act_dur) ):
                                        list_of_probs_dur.append( range_choice_dur.pop() )
        
                                    if choice_duration not in list_of_probs_dur : pass
                                    else : 
                                        duration = time_used
                                        time_left = ( len(time_slots) - slot_num )
                                        # check if the empty time slot is big enough
                                        if duration <= 0 : pass
                                        elif duration > time_left: 
                                            if slot_num >= 92:
                                                if time_slots[0] == None:
                                                    for t in range( time_left ):
                                                        time_slots[slot_num + d] = time_slots[0]
                                                    stop = 600
                                        else:
                                            for d in range( duration ):
                                                time_slots[slot_num + d] = activity[0]
                                                previous_activity = activity[0]
                                            stop = 600
                    stop += 1
        self.schedule_activities = time_slots
        return self.schedule_activities
#!!
    def __create_location_schedule__(self):
        schedule_lenght = len(self.schedule_activities)
        self.schedule_locations = []
        for a in range(schedule_lenght):
            if self.schedule_activities[a] == 'SLEEP':
                self.schedule_locations.append('HOUS')
            else:
                self.schedule_locations.append(self.schedule_activities[a][0:4])



    def __reserve_pod__(self,pod):
        self.nextpod = pod


    def __go_to__(self,point,i):
        self.vector = rs.VectorCreate(point,self.coordinates)/i
        self.distance = rs.VectorLength(self.vector)
        self.spatium += self.distance
        self.coordinates = rs.PointAdd(self.coordinates,self.vector)
        self.iterations_of_commuting += 1

    def __follow__(self,the_pod,i):
        self.destination = the_pod.destination
        self.vector = rs.VectorCreate(self.destination,self.coordinates)/i
        self.distance = rs.VectorLength(self.vector)
        self.spatium += self.distance
        self.coordinates = the_pod.coordinates
        self.iterations_of_commuting += 1




    def fix_activity_schedule(self):
        return self.schedule_activities    

    # MOVEMENT
    def __applyForce__(self, force, acc): 
        # force and acc are tuple (x,y,z) values
        f = force / self.mass
        acc += f
        return acc # tuple

    def __getSpeed__(self, vel):
        speed = vel.mag()
        return speed

    def __attracted__(self, obj):
        # parameter
        fc = self.force_attr_to_core
        f = self.force_attr
        
        # initial values
        pos = Vector(self.current_position)
        desired_target = Vector(self.next_destination)
        
        desired_vector = desired_target - pos
        desired_direction = desired_vector.unit()

        # attraction
        attr_pt = Vector(obj.position)
        distance = pos.distance(attr_pt)
        radius = obj.halo
        
        attr_vector = attr_pt - pos
        attr_direction = attr_vector.unit()

        # force
        force = f * (distance * fc / radius) 

        # calculate
        attr_acc = attr_direction * self.min_speed
        attr_acc = attr_acc * force / (self.travel_time)
        attr_acc = attr_acc.limit(self.min_speed)

        steer = desired_direction + attr_acc
        if steer.mag() > self.max_speed:
            steer = steer.limit(self.max_speed)
        elif steer.mag() < self.min_speed:
            steer *= 0
        else : pass

        # output
        self.attr_dir = attr_direction
        return Vector(steer)

# V01 ########################################
#    def __seperate__(self, others, acc):
#        desired_seperation = self.halo
#        desired_direction = self.direction 
#        sum = Vector()
#        count = 0
#        for other in others:
#            if self.id != other.id:
#                sp = Vector(self.current_position)
#                op = Vector(other.current_position)
#                d = sp.distance(op)
#                if ( d > 0 ) and ( d < desired_seperation ) : 
#                    diff = sp - op
#                    diff = diff.unit()
#                    diff /= d
#                    sum += diff
#                    count += 1
#                else: pass
#            else: pass
#        if count > 0 :
#            sum /= count
#            sum = sum.unit()
#            sum *= self.min_speed   # need to be reconsidered
#            steer = sum - acc
#            steer = steer.limit(self.max_force)
#            acc += steer
#            return Vector(acc)
#        else :
#            return Vector(acc)
# V02 ########################################
#    def __seperate__(self, others):
#        # SET initial values
#        desired_seperation = self.halo
#        desired_direction = self.direction
#        sum = Vector()
#        count = 0
#        
#        # LOOP through others
#        for other in others:
#            if self.id != other.id:
#                sp = Vector(self.current_position)
#                op = Vector(other.current_position)
#                d = sp.distance(op)
#                direction = sp - op
#                normal = sp.cross(op)
#                
#                #test
#                self.steer_avoid_normal = normal
#                steer = normal + desired_direction
#                sum += steer
#                count += 1
#            else : pass
#        if count > 0 :
#            steer = sum.unit()
#            self.steer_avoid = steer
#            return Vector(steer)
#        else : pass
## V03 ########################################
#    def __seperate__(self, others):
#        # SET initial values
#        desired_seperation = self.halo
#        desired_direction = self.direction
#        sum = Vector()
#        count = 0
#        
#        #TEST
#        self.to_avoid = None
#        
#        # LOOP through others
#        for other in others:
#            if self.id != other.id:
#                sp = Vector(self.current_position)
#                op = Vector(other.current_position)
#                d = sp.distance(op)
#                if ( d > 0 ) and ( d < desired_seperation ) :
#                    
#                    direction = op - sp
#                    normal = sp.cross(op)
#                    normal = normal.unit()
#                    #test
#                    self.steer_avoid_normal = normal
#                
#                    #steer update
#                    sum += normal
#                    count += 1
#                    
#                    #TEST
#                    self.to_avoid = op
#            else : pass
#        if count > 0 :
#            sum = sum.unit()
#            self.steer_avoid = sum
#            return Vector(sum)
#        else : 
#            return Vector(sum)
# V04 ########################################
    def __seperate__(self, others):
        # SET initial values
        desired_seperation = self.halo
        desired_direction = self.direction
        sum = Vector()
        count = 0
        
        #TEST
        self.to_avoid = None
        
        # LOOP through others
        for other in others:
            if self.id != other.id:
                sp = Vector(self.current_position)
                op = Vector(other.current_position)
                d = sp.distance(op)
                if ( d > 0 ) and ( d < desired_seperation ) :
                    vel1 = sp - op
                    vel1 = vel1.unit()
                    steer = vel1 + desired_direction

                    sum += steer
                    count += 1
                    
                    #TEST
                    self.to_avoid = op
            else : pass
        if count > 0 :
            sum = sum.unit()
            self.steer_avoid = sum
            return Vector(sum)
        else : 
            return Vector(sum)
    def update(self, others):
        # calculate travel time
        self.travel_time += 1


        # SET target and current position
        target = Vector(self.next_destination) 
        position = Vector(self.current_position)

        direction = target - position
        direction = direction.unit()
        self.direction = direction

        # GET distance between target / position
        distance =  target.distance(position)

        # A) ARRIVED
        if  distance <= self.arrived :
            # initialise when arrived at the target
            self.travel_time = 0
            vel = Vector()
            acc = Vector()

        # B) TRAVELING 
        else :
            # initial velocity
            vel = direction * self.min_speed

            # acceleration
            acc = direction * (self.acc_force * self.travel_time)
            acc = self.__applyForce__(self.gravity, acc)

#            acc = self.__seperate__(others, acc)
            # avoid near by others
            steer_avoid = self.__seperate__(others)
            steer_avoid *= self.force_avoid
            self.steer_avoid = steer_avoid

            # core gravity
            steer_core = self.__attracted__(self.core)
            self.steer_core = steer_core
            
            # all the steers
            steer = steer_avoid + steer_core
            self.steer = steer

            # APPLY to acceleration
            acc += steer

            # final velocity
            vel += acc
            speed = self.__getSpeed__(vel)

            # check speed limit
            if speed > self.max_speed : 
                vel = vel.speed_limit(self.max_speed)

            # check if inside the obj halo
            if distance < (self.arrival_zone * 2) :
                vel *= ( distance / self.arrival_zone )
                if speed < self.min_speed:
                    vel = direction * self.min_speed

        # finalising
        speed = self.__getSpeed__(vel)
        position += vel
        vel = Vector()
        acc = Vector()



        # outputs : updated values
        self.current_position = position
        self.distance = distance
        self.speed = speed
        if speed == 0 : self.is_travelling = False
        else : self.is_travelling = True

############################################################
# execute 
############################################################

# select archetype

people = []

if archetypes == True :
    if archetype_choice == archetype:
        for p in range( population ):
            people.append( MakePerson(archetype, p) )
    else : pass
else :
    for p in range( population ):
        people.append( MakePerson(archetype, p) )

############################################################
#  Creating people : END
############################################################
# ---------- end make_people ----------

# ----
# BOX & POINTS
box_size = Slider(500, range=10..1000)

dom = ConstructDomain(DomainStart=0, DomainEnd=box_size)
box = DomainBox(Base=PlaneXY(0, 0, 0), X=dom, Y=dom, Z=dom)
edges = BrepEdges(Brep=box)  # -> Naked, Interior, NonManifold
preview = CustomPreview(Geometry=edges.Interior, Material=ColourSwatch(SwatchColor=RGB(0, 0, 0)))

# ----
# Re-define
# Activity names
reset_activity_names = GhPythonScript(person=make_people)  # -> user
# ---------- reset_activity_names: Python ----------
__author__ = "Sangkyun Kim"
__version__ = "2019.01.10"

# Re-define activity names

home = [
        'EATING_DRINKING',
        'HOME JOB ACTIVITY',
        'HOME LEISURE',
        'HOUSE ACTIVITY',
        'HOUSEHOLD MEMBER CARING'
        ]

for i, act in enumerate( person.schedule_activities ):
    if act in home: 
        person.schedule_activities[i] = 'HOUSE ACTIVITY'

# Output
user = person
# ---------- end reset_activity_names ----------

python = GhPythonScript(
    users=reset_activity_names,
    max_amount_of_users=Slider(25, range=0..50, expression="x*100"),
    only_TheWhyFactory=Toggle(False),
    names=cluster.first_names_2,
    surnames=cluster.second_names_2)  # -> users; inputs users: list, max_amount_of_users: Int32, names: list, surnames: list
# ---------- python: Python ----------
lenght = min(len(names),len(users))

for i in range(lenght):
    users[i].first_name = names[i]
    users[i].last_name = surnames[i]

if only_TheWhyFactory == True:
    users = users[0:lenght]
else:
    users = users[0:max_amount_of_users]
# ---------- end python ----------

# ----
# LOCATIONS
location_schedual = GhPythonScript(USERS=python, R=cluster.rules, min=min_size, max=max_size, colors=render_mode_colors_2)  # -> out, USERS, BUILDINGS_NAMES, BUILDINGS_COLORS, BUILDINGS_SIZES; inputs USERS: list, R: tree, min: list, max: list of Int32, colors: list
# ---------- location_schedual: Python ----------
__author__ = "filip"
__version__ = "2019.01.18"

import random

usercounter = 0
for u in USERS:
    u.__create_location_schedule__()
    u.nr = "U{0:05}".format(usercounter)
    u.coordinates = None
    usercounter += 1
#    print u.schedule_activities
#    print u.schedule_locations


################################## RULES for SCHEDULE ###########################################

A = ['HOUSE ACTIVITY',	'SLEEP',	'WORK',	'SOCIALIZING',	'SPORTS',	'SHOPPING',	'CIVIC',	'EDUCATION',	'RELIGION']
B = ['HOUS',	'WORK',	'SOCI',	'SPOR',	'SHOP',	'CIVI',	'EDUC',	'RELI']
MAINS_dict = dict()
DURATIONS_dict = dict()

schedulelenght = len(USERS[0].schedule_locations)
print '>>>>>>>>>>>>', 'Schedule lenght:  ', schedulelenght

for i in range(8):
    if min[i]>max[i]:
        max[i] = int(min[i])


B_maxSIZES_dict = dict()
B_minSIZES_dict = dict()
B_SIZES_dict = dict()
B_OCCUPANCY_dict = dict()
B_OCCUPANCY_perSLOT_dict = dict()
B_COUNT_dict = dict()
B_COLORS_dict = dict()
BUILDINGS_NAMES = []
BUILDINGS_SIZES = []
BUILDINGS_COLORS = []
for b in range(len(B)):
    building = B[b]
    B_maxSIZES_dict[building] = max[b]
    B_minSIZES_dict[building] = min[b]
    B_SIZES_dict[building] = 0
    B_COUNT_dict[building]= 0
    B_COLORS_dict[building] = colors[b]
    B_OCCUPANCY_dict[building] = 0
    B_OCCUPANCY_perSLOT_dict[building] = []
    for s in range(schedulelenght):
        B_OCCUPANCY_perSLOT_dict[building].append(0)
    print building, B_OCCUPANCY_perSLOT_dict[building]
print '>>>>>>>>>>>> buildings dictionaries'
print '>>> min sizes: ', B_minSIZES_dict
print '>>> MAX sizes: ', B_maxSIZES_dict
print 'sizes: ', B_SIZES_dict
print 'occupancy ', B_OCCUPANCY_dict
print 'amounts of buildings ', B_COUNT_dict
#print 'colors: ', B_COLORS_dict

for a in range(len(A)):
    DURATIONS_dict[A[a]] = R.Branch(8)[a]
    MAINS_dict[A[a]] = R.Branch(9)[a]

Probablity = dict()
for b in range(len(B)):
    for a in range(len(A)):
        key = str(B[b]+A[a])
        Probablity[key] = []
        p0 = int(int(R.Branch(b)[a])/10)
        p1 = 10-p0
        for y in range(p0):
            Probablity[key].append(B[b])
        for n in range(p1):
            Probablity[key].append(R.Branch(9)[a])

#print '>>>>>>>>>>>> activity dictionaries'
#print Probablity
#print DURATIONS_dict
#print MAINS_dict

################################## LOCATION TYPE SCHEDULE MAKER ###########################################

schedulelenght = len(USERS[0].schedule_locations)
print '>>>>>>>>>>>>', 'Schedule lenght:  ', schedulelenght
print '>>>>>>>>>>>> LOCATION TYPE SCHEDULE'



for u in USERS: 
    slot = 0 
    while slot < schedulelenght-1:
        
        d = 1
        nextslot = slot + 1
        activity = str(u.schedule_activities[nextslot])
        while nextslot+d < schedulelenght and u.schedule_activities[slot+d] == u.schedule_activities[nextslot+d]:
            d += 1
        
        if d < int(DURATIONS_dict[activity]):
            location = str(random.choice(Probablity[u.schedule_locations[slot]+u.schedule_activities[nextslot]]))
#            if str(activity)[0:4] != location and activity != 'SLEEP':
#                print u.nr, '   slot:', nextslot, '   duration', d, '   at:', location, '  doing:', u.schedule_activities[nextslot]
        else:
            location = str(MAINS_dict[activity])
        
        indecies = range(nextslot, nextslot+d)
        for i in indecies:
            u.schedule_locations[i] = location
        
        slot = slot + d


################################## LOCATION MAKER ###########################################

print '>>>>>>>>>>>> LOCATION SCHEDULE'

for u in USERS:
    for b in B:
        if b in u.schedule_locations:
            if B_OCCUPANCY_dict[b] == B_SIZES_dict[b]:
                if b == 'HOUS':
                    print 'nowy dom!'
                B_COUNT_dict[b] += 1
                B_OCCUPANCY_dict[b] = 0
                newsize = int(random.randint(B_minSIZES_dict[b],B_maxSIZES_dict[b]))
                B_SIZES_dict[b] = int(newsize)
#                print B_COUNT_dict
                BUILDINGS_NAMES.append("{0}{1:05}".format(b,B_COUNT_dict[b]-1))
                BUILDINGS_COLORS.append(B_COLORS_dict[b])
                BUILDINGS_SIZES.append(newsize)
                for s in range(schedulelenght):
                    B_OCCUPANCY_perSLOT_dict[b][s] = 0
                
            for s in range(schedulelenght):
                if u.schedule_locations[s] == b:
                    u.schedule_locations[s] = "{0}{1:05}".format(u.schedule_locations[s],B_COUNT_dict[b]-1)
                    B_OCCUPANCY_perSLOT_dict[b][s] += 1
                    if B_OCCUPANCY_perSLOT_dict[b][s] > B_OCCUPANCY_dict[b]:
                        B_OCCUPANCY_dict[b] = int(B_OCCUPANCY_perSLOT_dict[b][s])
            if b == 'HOUS':
                print B_OCCUPANCY_perSLOT_dict[b]
# ---------- end location_schedual ----------

number_slider_3 = Slider(10, range=0..20, expression="x/100")
multiplication = Multiplication(A=number_slider_3, B=box_size)
addition = Addition(A=0, B=multiplication)
subtraction = Subtraction(A=box_size, B=multiplication)
dom_2 = ConstructDomain(DomainStart=addition, DomainEnd=subtraction)
list_length = ListLength(List=location_schedual.BUILDINGS_NAMES)
box_2 = DomainBox(Base=PlaneXY(0, 0, 0), X=dom_2, Y=dom_2, Z=dom_2)
series = Series(Start=0, Step=1, Count=list_length)
pop3d = Populate3D(Region=box_2, Count=1, Seed=series)  # -> flatten(BUILDINGS_Coordinates)

# ----
# THE MAIN CODE COMPONENT
number_slider_4 = Slider(240, range=0..360)
objects_speed_m_s = Slider(0.5, range=0..2)
simulation_lenght = Slider(24, range=0..200)
retrodicted_steps = Slider(0, range=-3..0)
predicted_steps = Slider(1, range=0..10)
number_slider_5 = Slider(3.6, range=2..6)
speed = Speed(A=objects_speed_m_s, B=number_slider_4)
the_code = GhPythonScript(
    simmulation_lenght=simulation_lenght,
    starting_schedule_slot=Slider(24, range=0..90),
    iterations_per_SCHEDUAL_Slot=number_slider_4,
    partitions=Slider(10, range=1..20),
    retrodiction=retrodicted_steps,
    prediction=predicted_steps,
    USERS=location_schedual.USERS,
    BUILDINGS_NAMES=location_schedual.BUILDINGS_NAMES,
    BUILDINGS_COLORS=location_schedual.BUILDINGS_COLORS,
    BUILDINGS_SIZES=location_schedual.BUILDINGS_SIZES,
    BUILDINGS_STARTINGCOORDINATES=pop3d,
    BUILDINGS_Speed=speed,
    BUILDINGS_Halo=Slider(20, range=5..100),
    squeezingPOWER=Slider(7, range=1..10),
    squeezing_area=Slider(0.4, range=0.1..1.1, expression="x-0.1"),
    boxSIZE=box_size,
    podSIZE=number_slider_5,
    dis=Slider(200, range=0..200),
    activities_colors=render_mode_colors,
    Empty_Pods_Colors=render_mode_colors_3)  # -> USERS, amount_of_iterations, BUILDINGS_Coordinates_inTIME, BUILDINGS_CORES_Coordinates_inTIME, BUILDINGS_CORES_Colors_inTIME, USER_X_coordiantes, USERS_Coordinates_inTIME, USERS_Colors_inTIME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; inputs simmulation_lenght: Int32, starting_schedule_slot: Int32, iterations_per_SCHEDUAL_Slot: Int32, partitions: Int32, ACTIVITIES_SCHEDULE: tree, retrodiction: Int32, prediction: Int32, USERS: list, BUILDINGS_NAMES: list, BUILDINGS_COLORS: list, BUILDINGS_SIZES: list, BUILDINGS_STARTINGCOORDINATES: list of Point3d, squeezingPOWER: Int32, activities_colors: list, Empty_Pods_Colors: list
# ---------- the_code: Python ----------
__author__ = "filip"
__version__ = "2018.11.30"
                        
import rhinoscriptsyntax as rs
import random




BQ = len(BUILDINGS_NAMES) # BUILDINGS Quantity - the amount of buildings
BQ2 = BQ**2
BC = BUILDINGS_STARTINGCOORDINATES

BUILDINGS_Coordinates_inTIME = [] # lists of coordinates of all buildings for all iterations
BUILDINGS_CORES_Coordinates_inTIME = []
BUILDINGS_CORES_Colors_inTIME = []
BUILDINGS_Occupancy_inTIME = [] # lists of occupancy of all the buildings for all iterations

UQ = len(USERS) # USER Quantity - the amount of users
UC=[] # users corinates
USER_X_coordinates = []
USERS_Colors_inTIME=[] # colors for all users in all iterations
USERS_Coordinates_inTIME = []

PODS_Coordinates_inTIME = []
PODS_Colors_inTIMES = []
PODS_Occupancy_inTIME = []

PATHS_inTIME =[]
avrageCOMMUTEdistance_inTIME =[]
avrageCOMMUTEtime_inTIME =[]

users_ACTIVITIES_inTIME = []
TEXT_coordinate_inTIME = []
TEXT_inTIME = [] # to delete!
PRINT_LOG_inTIME = []
PRINT_LOG = []
TIME = []

iNR = 0 
Vzero = rs.CreateVector(0,0,0)
Pzero = rs.CreatePoint(0,0,0)
hbS = boxSIZE/2 # half of box size
pheryphery_border1 = squeezing_area * hbS
pheryphery_border2 = boxSIZE - pheryphery_border1
squeezing_multiplier = squeezingPOWER/(pheryphery_border1)**2
maxHALOsize = BUILDINGS_Halo
maxflow = 0


def IDcomponent(cooridante):
    id_component, distance = divmod(cooridante,module)
    id_component = int(id_component)
    id_component = min(id_component, partitions-1)
    id_component = max(id_component, 0)
    return id_component


def Squeezer(coordinate):
    if coordinate < pheryphery_border1:
        squeezerVECTORcoordinate = min((coordinate - pheryphery_border1)**2*squeezing_multiplier,BUILDINGS_Halo)
    elif coordinate > pheryphery_border2:
        squeezerVECTORcoordinate = -min((coordinate - pheryphery_border2)**2*squeezing_multiplier,BUILDINGS_Halo)
    else:
        squeezerVECTORcoordinate = 0
    return squeezerVECTORcoordinate


##################################################################################
#################################### SKY CITY zoneS ##############################
##################################################################################
                        
module = boxSIZE / partitions
N = [-1,0,1]
ZONES = dict()
                        
class Zone(object):
                        
    def __init__(self, x,y,z):
        self.id = 'C%.2d%.2d%.2d' % (x, y, z)
        self.coordinates = module*(x+0.5), module*(y+0.5), module*(z+0.5)
        self.neighbours = []
        self.buildings = []
        self.users = []
        self.pods = []
    def __repr__(self):
        return self.id
                        
                        
for x in range(partitions):
    for y in range(partitions):
        for z in range(partitions):
            zone = Zone(x,y,z)
            key = zone.id
            ZONES[key] = zone
            for xn in N:
                for yn in N:
                    for zn in N:
                        xf = x + xn
                        yf = y + yn
                        zf = z + zn
                        if xf >= 0 and yf >=0 and zf >=0 and xf < partitions and yf < partitions and zf < partitions:
                            ZONES[key].neighbours = ZONES[key].neighbours+['C%.2d%.2d%.2d' % (xf, yf, zf)]


##################################################################################
#################################### CELLS #######################################
##################################################################################
                        
print '>>> max size of a building: ', max(BUILDINGS_SIZES)
size_of_a_grid_for_buildings = 3*max(BUILDINGS_SIZES)
core_sizes = [1]
                        
                        
GC_Plus = [False, False, False]
GC_Size = [0,0,0]
GC_Rows = [[0],[0],[0]]
CELLS = [rs.CreateVector(0,0,0)]
gridcells = 1
gvc = dict()
a = 0
                        
while gridcells < size_of_a_grid_for_buildings: 
    b = (a + 1) % 3
    c = (b + 1) % 3
    if GC_Plus[a]:
        GC_Size[a] = -GC_Size[a]
        GC_Plus[a] = False
        GC_Rows[a] = [GC_Size[a]]+GC_Rows[a]
    else:
        GC_Size[a] = -GC_Size[a]+1
        GC_Plus[a] = True
        GC_Rows[a] = GC_Rows[a] + [GC_Size[a]]
                            
    gvc['c'+str(a)] = [GC_Size[a]]
    gvc['c'+str(b)] = GC_Rows[b]
    gvc['c'+str(c)] = GC_Rows[c]
                            
    for x in gvc['c0']:
        for y in gvc['c1']:
            for z in gvc['c2']:
                CELLS.append(rs.CreateVector(x,y,z))
                gridcells += 1
    core_sizes.append(gridcells)
    a = b
                        
for c in range(len(CELLS)):
    CELLS[c] = CELLS[c]*4
                        
def Core_Size(amount_of_pods):
    s = int(amount_of_pods/5)+1
    counter = 0
    core_size = core_sizes[counter]
    while core_sizes[counter] < s:
        counter += 1
        core_size = core_sizes[counter]
    return core_size
                        
##################################################################################
################################  !BUILDINGS!   ##################################
##################################################################################
                        
class Building(object):
                        
    def __init__(self, id, point, color, size):
        self.id = id
        self.coordinates = point
        self.zone = 'C%.2d%.2d%.2d' % (IDcomponent(point[0]), IDcomponent(point[1]), IDcomponent(point[2]))
        self.color = color
        self.size = size
        self.members = []
        self.users = []
        self.pods = []
        self.flows = dict()
        self.flowsum = 0
        self.flowvector = Vzero
        self.separationvector = Vzero
        self.occupancy = 0
        self.movementvector = Vzero

        
        cs = Core_Size(self.size)
        self.cellsofcore = CELLS[0:cs]
        self.cells = CELLS[cs:cs+size*3]
        self.initialcells = len(self.cells)
        

    def __zone__(self):
        x = IDcomponent(self.coordinates[0])
        y = IDcomponent(self.coordinates[1])
        z = IDcomponent(self.coordinates[2])
        self.zone = 'C%.2d%.2d%.2d' % (x, y, z)

    def __addflow__(self,buildig):
        self.flowsum += 1
        if buildig not in self.flows:
            self.flows[buildig] = 1
        else:
            self.flows[buildig] += 1

    def __reserve_cell__(self):
        cell = self.cells[random.randint(0,len(self.cells)-1)]
        self.cells.remove(cell)
        return cell

    def  __release_from__(self,cell_to_return):
        self.cells.append(cell_to_return)


    def __move_to__(self,b):
        rout = ROUTS[self.id+b]
        self.flowvector = rs.VectorAdd(rout.unit * self.flows[b], self.flowvector)

    def __separate_from__(self,B):
        self.separationvector = self.separationvector + ROUTS[B+self.id].unit * min(BUILDINGS_Halo/2,BUILDINGS_Halo**2/ROUTS[B+self.id].distance**2)



    def __clean__(self):
        self.__zone__()
        self.flowvector = Vzero
        self.separationvector = Vzero
        self.movementvector = Vzero

    def __totalclean__(self):
        self.occupancy = 0
        self.flows = dict()
        self.flowsum = 0
        global maxflow
        maxflow = 0
                        
### FOR BUILDING CLASS
##  FOR ZONE def
#        if x in bounderyindecies or y in bounderyindecies or z in bounderyindecies:
#            self.peripheral = True
#        else:
#            self.peripheral = False
##  FOR __addflow__ def
#        global maxflow 
#        if self.flowsum > maxflow:
#            maxflow = self.flowsum
                        
BQ = len(BUILDINGS_NAMES)
BUILDINGS = dict()
BUILDINGS_List = []
for b in range(BQ):
    building = Building(BUILDINGS_NAMES[b],BUILDINGS_STARTINGCOORDINATES[b],BUILDINGS_COLORS[b],BUILDINGS_SIZES[b])
    BUILDINGS[building.id] = building
    BUILDINGS_List.append(building)
    for c in ZONES[building.zone].neighbours:
        ZONES[c].buildings.append(building.id)

Y_total = 0 
Y_empty = 0
for b in BUILDINGS:
    buix = BUILDINGS[b]
    Y_total += buix.initialcells
    Y_empty += len(buix.cells)
print Y_total, Y_empty


##################################################################################
#################################### !PODS! ######################################
##################################################################################
                        
activities = ['HOUSE ACTIVITY','SLEEP','WORK','SOCIALIZING','SPORTS','SHOPPING','CIVIC','EDUCATION','RELIGION']
ACTIVITIES_COLORS = dict()
INACTIVE_COLORS = dict()
for a in range(9):
    ACTIVITIES_COLORS[activities[a]] = activities_colors[a]
    INACTIVE_COLORS[activities[a]] = Empty_Pods_Colors[a]

PODS_dict = dict()
avaliblePODS = dict()
for a in activities:
    avaliblePODS[a] =[]

PQ = 0 # pods quanitity


class Pod(object):

    def __init__(self,PQ,user):
        self.id = 'P{0:05}'.format(PQ)
        self.activity = user.nextactivity
        self.color_active = ACTIVITIES_COLORS[self.activity]
        self.color_inactive = INACTIVE_COLORS[self.activity]
        self.color = self.color_active 
        self.user = user.nr
        self.nextlocation = user.nextlocation
        self.location = self.nextlocation
        self.departed = False
        self.todiscard = False
        self.abandoned = False
        x = random.randint(0,boxSIZE)
        y = random.randint(0,boxSIZE)
        height = boxSIZE*2
        self.coordinates = rs.CreatePoint(x,y,height)
        self.travel_with_user = False

    def __reserve__(self,cell,building,temporary):
        self.nextcell = cell
        self.color = self.color_active
        if temporary:
            self.temporary_building = building
            self.temporary_cell = cell
            self.temporary_reservation = True
        else:
            self.building = building
            self.building_cell = cell

    def __update_plan__(self):
        self.departed = False
        self.todiscard = False
        self.travel_with_user = False
        self.temporary_reservation = False
        self.abandoned = False
        self.cell = self.nextcell
        return user.nr[1:0]

    def __let_go_after_that_slot__(self):
        self.todiscard = True
        self.travel_with_user = True

    def __discard_after_that_slot__(self):
        self.todiscard = True
        self.abandoned = True

    def __fly__(self,progress):
        self.destination = rs.PointAdd(BUILDINGS[self.nextlocation].coordinates,self.nextcell)
        vector = rs.VectorCreate(self.destination,self.coordinates)/leftiterations
        self.coordinates = rs.PointAdd(self.coordinates,vector)

    def __stay__(self):
        self.coordinates = rs.PointAdd(BUILDINGS[self.location].coordinates,self.cell)

    def __sink__(self,modifier):
        height = -(self.coordinates[2]-1.8)
        v = rs.CreateVector(0,0,height/boxSIZE*2*BUILDINGS_Speed/modifier)
        self.coordinates = rs.PointAdd(self.coordinates,v)

PODS_list = []

for user in USERS:
    user.spatium = 0.0
    user.iterations_of_commuting = 0
    user.activity = user.schedule_activities[starting_schedule_slot]
    user.nextactivity = user.activity
    user.location = user.schedule_locations[starting_schedule_slot]
    user.nextlocation = user.location


    pod = Pod(PQ,user)
    key = pod.id
    PODS_list.append(pod)
    PODS_dict[key] = pod
    PQ +=1


    building = BUILDINGS[user.nextlocation]
    cell = building.__reserve_cell__()
    pod.__reserve__(cell,building,False)
    pod.coordinates = rs.PointAdd(building.coordinates,pod.nextcell)
    user.coordinates = pod.coordinates
    user.__reserve_pod__(pod)
    user.pod = user.nextpod


#####################################################################################
#####################################  !ROUTS!   ####################################
#####################################################################################
                        
class Route(object):
                        
    def __init__(self, b1, b2):
        self.id = b1+b2
        self.counted = False
        self.vector = Vzero
        self.distance = 0.0
        self.unit = Vzero
                        
    def __update__(self, other,b1,b2):
                                
        self.counted = True
        other.counted = True
                                
        self.vector = rs.VectorCreate(BUILDINGS[b2].coordinates,BUILDINGS[b1].coordinates)
        other.vector = - self.vector
                                
        self.distance = rs.VectorLength(self.vector)
        other.distance = self.distance
                                
        self.unit = self.vector / self.distance
        other.unit = - self.unit
                        
    def __clean__(self):
        self.counted = False
                        
    def __repr__(self):
        return self.id


ROUTS = dict()
for b1 in BUILDINGS:
    for b2 in BUILDINGS:
        if b1 != b2:
            routename = b1+b2
            ROUTS[routename] = Route(b1,b2)
                        
print 'amount of routs:', len(ROUTS)
                        
                        
##################################################################################
'################################################################################'
################################# SIMMULATION ####################################
'################################################################################'
'################################################################################'
################################# !START! ########################################
'################################################################################'
################## SCHEDUAL predition & redtrodiction Slots ######################
'################################################################################'

iterationduration = int(900/iterations_per_SCHEDUAL_Slot)
schedule_lenght = len(USERS[0].schedule_locations)
amount_of_iterations = simmulation_lenght * iterations_per_SCHEDUAL_Slot
simulations_slots = range(starting_schedule_slot, starting_schedule_slot+simmulation_lenght)
tested_slots = range(starting_schedule_slot+retrodiction, starting_schedule_slot+simmulation_lenght+prediction)
prediction_and_retrodicion_slots = range(retrodiction,prediction+1)
amount_of_transitions = len(prediction_and_retrodicion_slots)-1
                        
for s in range(simmulation_lenght):
    simulations_slots[s] = simulations_slots[s] % schedule_lenght
for s in range(simmulation_lenght+prediction-retrodiction):
    if tested_slots > 0:
        tested_slots[s] = tested_slots[s] % schedule_lenght


for frame in range(simmulation_lenght):

    slot = simulations_slots[frame]
    nextslot = (slot + 1) % schedule_lenght
    slotrange = []
    for s in prediction_and_retrodicion_slots:
        slotrange.append(tested_slots[frame-retrodiction+s])


    for pod_to_update in PODS_list:
        if pod_to_update.todiscard:
            if pod_to_update.temporary_reservation:
                pod_to_update.temporary_building.__release_from__(pod_to_update.temporary_cell)
            avaliblePODS[pod_to_update.activity].append(pod_to_update)
            pod_to_update.building.__release_from__(pod_to_update.building_cell)
            pod_to_update.color = pod_to_update.color_inactive
        pod_to_update.__update_plan__()
    Mutable_Users = []


    for user in USERS:
        user.changes_activity = False
        for t in range(amount_of_transitions):
            if user.schedule_locations[slotrange[t]] != user.schedule_locations[slotrange[t+1]]:
                BUILDINGS[user.schedule_locations[slotrange[t]]].__addflow__(user.schedule_locations[slotrange[t+1]])
                BUILDINGS[user.schedule_locations[slotrange[t+1]]].__addflow__(user.schedule_locations[slotrange[t]])
        user.location = user.schedule_locations[slot]
        user.activity = user.schedule_activities[slot]
        user.nextlocation = user.schedule_locations[nextslot]
        user.nextactivity = user.schedule_activities[nextslot]
        user.color = ACTIVITIES_COLORS[user.activity]
        user.pod = user.nextpod
        previous_pod = user.pod


        if user.activity != user.nextactivity:
            Mutable_Users.append(user)
            user.changes_activity = True
            building = BUILDINGS[user.nextlocation]
            nextcell = building.__reserve_cell__()
            aditional_text = str()
            previous_pod.__discard_after_that_slot__()

            if user.location != user.nextlocation:
                user.relocating = True
                user.departed = False

                user.relocating = True
                user.departed = False
                user.podtravel = random.choice([True,False])
                
                if user.podtravel:
                    previous_pod.nextlocation = user.nextlocation 
                    temporarycell = building.__reserve_cell__()
                    previous_pod.__reserve__(temporarycell,building,True)
                    user.text = '({1}) {0} travels by pod to {2} object!'.format(user.first_name,user.nr[-2:],user.nextactivity)

                else:
                    user.text = '({1}) {0} goes to {2} object!'.format(user.first_name,user.nr[-2:],user.nextactivity)

            else:
                user.relocating = False
                user.text = '({1}) {0} asked for {2} pod!'.format(user.first_name,user.nr[-2:],user.nextactivity)

            if avaliblePODS[user.nextactivity] == []:
                users_pod = Pod(PQ,user)
                key = users_pod.id
                PODS_dict[key] = users_pod
                PODS_list.append(users_pod)
                PQ += 1

            else:
                emptypodsTYPE = avaliblePODS[user.nextactivity]
                users_pod = random.choice(emptypodsTYPE)
                emptypodsTYPE.remove(users_pod)


            users_pod.__reserve__(nextcell,building,False)
            users_pod.nextlocation = str(user.nextlocation)
            user.nextpod = users_pod

        else:
            user.relocating = False
            pod_to_leave_after_slot = user.pod
            pod_to_leave_after_slot.abandoned = True

#    print 'amount of pods:', PQ

    print_log_counter = 0
    mutable_users_amount = len(Mutable_Users)
    print_moments = []
    if mutable_users_amount > 0:
        text_frequency = iterations_per_SCHEDUAL_Slot /mutable_users_amount
        for i in range(mutable_users_amount):
            print_moments.append(i*text_frequency)


#################################################################################################
########################################## ITERATIONS ###########################################
#################################################################################################

    print("Simmulation slot: "+str(frame)+"    |    schedual slots number: "+str(slot))

    Y_empty = 0
    for b in BUILDINGS:
        buix = BUILDINGS[b]
        Y_empty += len(buix.cells)
    print Y_total, Y_empty


    for iteration in range(iterations_per_SCHEDUAL_Slot):

        s_count = int(iNR*iterationduration)
        m_count, seconds = divmod(s_count, 60)
        hour_counter, minute_counter = divmod(m_count, 60)
        nychthemeron, hour_counter = divmod(hour_counter, 24)
        nychthemeron += 1

        minutes = m_count + starting_schedule_slot*15
        hours, minutes = divmod(minutes, 60)
        day, hours = divmod(hours, 24)
#        if nychthemeron == 1:
        time = '{0:01}:{1:02}:{2:02}'.format(hours, minutes, seconds)
#        else:
#            time = '{0} nychthemeron {1:01}:{2:02}:{3:02}'.format(nychthemeron, hours, minutes, seconds)

#        print 'TIME:', time,"    |    Simmulation slot: "+str(frame)+"    |    schedual Slots number: "+str(slot)+"    |    iteration of a slot: "+str(iteration)+"    |    iteration: "+str(iNR)


        BUILDINGS_squeezingVECTORS = [] # separation vectors between all buildings 
        BUILDINGS_MOVEMNT=[]


        for b in BUILDINGS:
            ZONES[BUILDINGS[b].zone].buildings = []
        for b in BUILDINGS:
            for c in ZONES[BUILDINGS[b].zone].neighbours:
                ZONES[c].buildings.append(BUILDINGS[b].id)
        for r in ROUTS:
            ROUTS[r].__clean__()


######################## VECTORS and DISTANCES between all OBJECTS ########################
                        
                        
        for b1 in BUILDINGS:
            b = BUILDINGS[b1]
            for b2 in BUILDINGS[b1].flows:
                if ROUTS[b1+b2].counted == False:
                    ROUTS[b1+b2].__update__(ROUTS[b2+b1], b1, b2)
                b.__move_to__(b2)
            b.flowvector = b.flowvector / max(b.flowsum,1)
                                    
                        
            for b2 in ZONES[b.zone].buildings:
                if b2 != b1:
                    if ROUTS[b1+b2].counted == False:
                        ROUTS[b1+b2].__update__(ROUTS[b2+b1], b1, b2)
                    b.__separate_from__(b2)

                        
                        
        for b in BUILDINGS_NAMES:
            bc = BUILDINGS[b].coordinates
#            if BUILDINGS[BUILDINGS_NAMES[i]].peripheral == True:
            BUILDINGS_squeezingVECTORS.append(rs.CreateVector(Squeezer(bc[0]),Squeezer(bc[1]),Squeezer(bc[2]-5)))
#            else:
#                BUILDINGS_squeezingVECTORS.append(Vzero)
                        
                        
######################## MOVEMNET of OBJECTS according to DISTANCES ########################

        BUILDINGS_CORES_Coordinates_inTIME.append([])
        BUILDINGS_CORES_Colors_inTIME.append([])
        BUILDINGS_Coordinates_inTIME.append([])
        
        modifier = max(int(iterations_per_SCHEDUAL_Slot/10)-iteration,1)
        
        for i in range(BQ):
            b = BUILDINGS[BUILDINGS_NAMES[i]]
            BUILDINGS_MOVEMNT.append(Vzero)
            BUILDINGS_MOVEMNT[i]=rs.VectorAdd(BUILDINGS_MOVEMNT[i],BUILDINGS_squeezingVECTORS[i])
            BUILDINGS_MOVEMNT[i]=rs.VectorAdd(BUILDINGS_MOVEMNT[i],b.flowvector)
            BUILDINGS_MOVEMNT[i]=rs.VectorAdd(BUILDINGS_MOVEMNT[i],b.separationvector)
            b.movementvector = BUILDINGS_MOVEMNT[i]*BUILDINGS_Speed/modifier 
                
            b.coordinates = rs.VectorAdd(BC[i],b.movementvector)
            BC[i] = b.coordinates
            BUILDINGS_Coordinates_inTIME[iNR].append(b.coordinates)
            for cell in b.cellsofcore:
                BUILDINGS_CORES_Coordinates_inTIME[iNR].append(rs.VectorAdd(b.coordinates,cell))
                BUILDINGS_CORES_Colors_inTIME[iNR].append(b.color)


################################# MOVEMNET of USERS #################################



        leftiterations = float(iterations_per_SCHEDUAL_Slot-iteration)
        USERS_Coordinates_inTIME.append([])
        USERS_Colors_inTIME.append([])

        if iteration < 2.0/3.0*iterations_per_SCHEDUAL_Slot:
            for user in USERS:
                if user.activity != user.nextactivity:
                    newpod = user.nextpod
                    newpod.__fly__(leftiterations)
                pod_in_use = user.pod
                pod_in_use.__stay__()
                user.coordinates = pod_in_use.coordinates
                USERS_Coordinates_inTIME[iNR].append(user.coordinates)
                USERS_Colors_inTIME[iNR].append(user.color) #C

                
        else:
            migrationprogress = round(3.0*float(iteration)/float(iterations_per_SCHEDUAL_Slot)-2,2)
#            print 'iNR:', iNR, 'slot simulation progress:', migrationprogress,  '%'
            for user in USERS:
                departurelocation = BUILDINGS[user.location]
                oldpod = user.pod
                newpod = user.nextpod
                if user.relocating:
                    if oldpod.departed == False:
                        vector = rs.VectorCreate(BUILDINGS[user.nextlocation].coordinates,user.coordinates)
                        if migrationprogress > 2.0/3.0*(1.0-rs.VectorLength(vector)/dis):
                            newpod.__fly__(leftiterations)
                            oldpod.departed = True
                            if user.podtravel == True:
                                oldpod.__fly__(leftiterations)
                                user.__follow__(oldpod,leftiterations)
                            else:
                                oldpod.__stay__()
                                avaliblePODS[oldpod.activity].append(oldpod) 
                                oldpod.color = oldpod.color_inactive
                                user.__go_to__(newpod.destination,leftiterations)
                        else:
                            newpod.__fly__(leftiterations)
                            oldpod.__stay__()
                            user.coordinates = oldpod.coordinates

                    else:
                        newpod.__fly__(leftiterations)
                        if user.podtravel:
                            oldpod.__fly__(leftiterations)
                            user.__follow__(oldpod,leftiterations)
                        else:
                            user.__go_to__(newpod.destination,leftiterations)
                else:
                    if user.activity != user.nextactivity:
                        newpod.__fly__(leftiterations)
                    oldpod.__stay__()
                    user.coordinates = oldpod.coordinates
                
                USERS_Coordinates_inTIME[iNR].append(user.coordinates)
                USERS_Colors_inTIME[iNR].append(user.color) #C
        
        for podtype in avaliblePODS:
            if avaliblePODS[podtype] != []:
                for emptypod in avaliblePODS[podtype]:
                    emptypod.__sink__(modifier)



        PODS_Coordinates_inTIME.append([])
        PODS_Colors_inTIMES.append([])
        for pod in PODS_list:
            PODS_Coordinates_inTIME[iNR].append(pod.coordinates)
            PODS_Colors_inTIMES[iNR].append(pod.color)


        commute_distance = 0.0
        total_iterations_of_commuting = 0
        PATHS_inTIME.append(([],[]))
        for user in USERS:
            commute_distance += user.spatium
            total_iterations_of_commuting += user.iterations_of_commuting
            if user.relocating:
                PATHS_inTIME[iNR][0].append(user.coordinates)
                PATHS_inTIME[iNR][1].append(BUILDINGS[user.nextlocation].coordinates)

        avarage_commute_time_in_seconds = int(total_iterations_of_commuting/UQ*iterationduration)
        commute_min, commute_sec = divmod(avarage_commute_time_in_seconds,60)
        commute_h, commute_min = divmod(commute_min,60)
        if commute_h > 0:
            avarage_commute_time ='{0} h {1} m {2} s'.format(commute_h, commute_min, commute_sec)
        elif commute_min > 0:
            avarage_commute_time ='{0} min {1} sec'.format(commute_min, commute_sec)
        else:
            avarage_commute_time ='{0} seconds'.format(commute_sec)

        avarage_commute_distance_in_meters = round(commute_distance/UQ,2)
        commute_km, commute_m = divmod(int(avarage_commute_distance_in_meters),1000)
        if commute_km > 0:
            avarage_commute_distance ='{0} km {1} m'.format(commute_km, commute_m)
        else:
            avarage_commute_distance ='{0} meters'.format(avarage_commute_distance_in_meters)
        avrageCOMMUTEdistance_inTIME.append(avarage_commute_distance)
        avrageCOMMUTEtime_inTIME.append(avarage_commute_time)
        TIME.append(time)

        activities_amounts = []
        for a in range(9):
            activity = activities[a]
            activities_amounts.append(0)
            for u in USERS:
                if u.activity == activity:
                    activities_amounts[a] +=1
        users_ACTIVITIES_inTIME.append(activities_amounts)
        PODS_Occupancy_inTIME.append(round(UQ/PQ,2))


        if mutable_users_amount > 0:
            while print_log_counter < mutable_users_amount and iteration >= print_moments[print_log_counter]:
                PRINT_LOG = PRINT_LOG[-5:]
                PRINT_LOG.append(time+':  '+Mutable_Users[print_log_counter].text)
                print_log_counter += 1
        PRINT_LOG_inTIME.append(PRINT_LOG)
 
        TEXT_inTIME.append([])
        TEXT_coordinate_inTIME.append([])
        for user in USERS:
            if user.changes_activity == True: 
                TEXT_inTIME[iNR].append(user.nr[-2:])
                TEXT_coordinate_inTIME[iNR].append(user.coordinates)

        iNR +=1
        for b in BUILDINGS:    
            BUILDINGS[b].__clean__()
    for b in BUILDINGS:    
        BUILDINGS[b].__totalclean__()

USERS_commute_data = []
for user in USERS:
    u_commute_sec = user.iterations_of_commuting*iterationduration
    u_commute_min, u_commute_sec = divmod(u_commute_sec,60)
    u_commute_h, u_commute_min = divmod(u_commute_min,60)
    USERS_commute_data.append([user.first_name,user.last_name,int(user.spatium),'{0:02}:{1:02}:{2:02}'.format(u_commute_h, u_commute_min, u_commute_sec)])
# ---------- end the_code ----------
# ----
# SAVE RESULTS TO CSV
panel_2 = Panel("C:\Users\filip\Documents\Architektura\MSc1\MSc1 The Why Factory\3Dmove code\3Dmove simulation results\3Dmove simulationOUTPUT 19-01-19 v03")
python_2 = GhPythonScript(
    folder=panel_2,
    podsLOATIONS_fileNAME="podsLOCATIONS.csv",
    buildingsLOATIONS_fileNAME="buildingsLOCATIONS.csv",
    podsCOLORS_fileNAME="podsCOLORS.csv",
    buildingsCOLORS_fileNAME="buildingsCOLORS.csv",
    conector="\")  # -> out, buildingsCOLORS_PATH, buildingsLOATIONS_PATH, podsLOATIONS_PATH, podsCOLORS_PATH
# ---------- python_2: Python ----------
__author__ = "filip"
__version__ = "2019.01.17"

import rhinoscriptsyntax as rs

if podsLOATIONS_fileNAME != None:
    podsLOATIONS_PATH = folder + conector + podsLOATIONS_fileNAME

if buildingsLOATIONS_fileNAME != None:
    buildingsLOATIONS_PATH = folder + conector + buildingsLOATIONS_fileNAME

if podsCOLORS_fileNAME != None:
    podsCOLORS_PATH = folder + conector + podsCOLORS_fileNAME

if buildingsCOLORS_fileNAME != None:
    buildingsCOLORS_PATH = folder + conector + buildingsCOLORS_fileNAME
# ---------- end python_2 ----------
save_file = SAVEFILE(
    listofnames=location_schedual.BUILDINGS_NAMES,
    listofcolours=location_schedual.BUILDINGS_COLORS,
    fileaddress=python_2.buildingsCOLORS_PATH,
    list=the_code.BUILDINGS_Coordinates_inTIME,
    fileaddress_2=python_2.buildingsLOATIONS_PATH,
    list_2=the_code.USERS_Coordinates_inTIME,
    fileaddress_3=python_2.podsLOATIONS_PATH,
    list_3=the_code.USERS_Colors_inTIME,
    fileaddress_4=python_2.podsCOLORS_PATH)  # disabled
panel_3 = Panel(save_file)

tree = GhPythonScript(nestetd_lists=the_code.USERS_commute_data)  # -> tree; inputs nestetd_lists: list
# ---------- tree: Python ----------
__author__ = "filip"
__version__ = "2019.01.26"

import rhinoscriptsyntax as rs
import clr
clr.AddReference("Grasshopper")
from Grasshopper.Kernel.Data import GH_Path
from Grasshopper import DataTree

tree = DataTree[object]()
for i in range(len(nestetd_lists)):
    list = nestetd_lists[i]
    tree.AddRange(list,GH_Path(i))
# ---------- end tree ----------

# ----
# DISPLAYER
toggle = BooleanToggle(True)
number_of_iterartions = Panel(the_code.amount_of_iterations)
counter = Counter(Reset=toggle)
cluster_2 = Object(B_2=number_slider_4, A=Slider(4818, range=0..10000), B=number_of_iterartions)  # -> R_2, R
panel_4 = Panel(cluster_2.R_2)
displayer = GhPythonScript(
    t=cluster_2.R,
    ITERATIONSperFRAME=number_slider_4,
    BUILDINGS_CORES_Coordinates_inTIME=the_code.BUILDINGS_CORES_Coordinates_inTIME,
    BUILDINGS_CORES_Colors_inTIME=the_code.BUILDINGS_CORES_Colors_inTIME,
    BUILDINGS_Coordinates_inTIME=the_code.BUILDINGS_Coordinates_inTIME,
    userPOSITIONS=the_code.USERS_Coordinates_inTIME,
    userCOLORS=the_code.USERS_Colors_inTIME,
    PODS_Coordinates_inTIME=the_code.PODS_Coordinates_inTIME,
    PODS_Colors_inTIME=the_code.PODS_Colors_inTIMES,
    PATHS_inTIME=the_code.PATHS_inTIME,
    COMMUTE_distance_inTIME=the_code.avrageCOMMUTEdistance_inTIME,
    COMMUTE_time_inTIME=the_code.avrageCOMMUTEtime_inTIME,
    PODS_Occupancy_inTIME=the_code.PODS_Occupancy_inTIME,
    users_ACTIVITIES_inTIME=the_code.users_ACTIVITIES_inTIME,
    TEXT_coordinate_inTIME=the_code.TEXT_coordinate_inTIME,
    TEXT_inTIME=the_code.TEXT_inTIME,
    PRINT_LOG_inTIME=the_code.PRINT_LOG_inTIME,
    TIME=the_code.TIME)  # -> out, simplify(flatten(cors)), cors_colors, simplify(flatten(objectOCCUPANCYinTIME)), podsCOORDINATES, podsCOLORS, userPOSITIONSinTIME, userCOLORSinTIME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; inputs t: Int32, BUILDINGS_CORES_Coordinates_inTIME: list, BUILDINGS_CORES_Colors_inTIME: list, BUILDINGS_Coordinates_inTIME: list, userPOSITIONS: list, userCOLORS: list, PODS_Coordinates_inTIME: list, PODS_Colors_inTIME: list, PATHS_inTIME: list, COMMUTE_distance_inTIME: list, COMMUTE_time_inTIME: list, PODS_Occupancy_inTIME: list, users_ACTIVITIES_inTIME: list, TEXT_coordinate_inTIME: list, TEXT_inTIME: list, PRINT_LOG_inTIME: list, TIME: list
# ---------- displayer: Python ----------
__author__ = "filip"
__version__ = "2018.12.07"

import rhinoscriptsyntax as rs

cors = BUILDINGS_CORES_Coordinates_inTIME[t]
cors_colors = BUILDINGS_CORES_Colors_inTIME[t]
#objectOCCUPANCYinTIME = objectOCCUPANCY[int(t/ITERATIONSperFRAME)]
userPOSITIONSinTIME = userPOSITIONS[t]
userCOLORSinTIME = userCOLORS[t]
podsCOORDINATES = PODS_Coordinates_inTIME[t]
podsCOLORS = PODS_Colors_inTIME[t]
point1 = PATHS_inTIME[t][0]
point2 = PATHS_inTIME[t][1]
commute_distance = COMMUTE_distance_inTIME[t]
commute_time = COMMUTE_time_inTIME[t]
pod_occupancy = PODS_Occupancy_inTIME[t]
activities = users_ACTIVITIES_inTIME[t]
text_coordiantes = TEXT_coordinate_inTIME[t]
print_log = PRINT_LOG_inTIME[t]
text = TEXT_inTIME[t]
time = TIME[t]

#totalCOMMUTEdistanceinTIMEframe = str("Total commute of users:  "+str(int(totalCOMMUTEdistanceLIST[t]))+" km")
# ---------- end displayer ----------
panel_5 = Panel(cluster_2.R)

# ----
# START
timer = Timer(TimerInterval=20, Target=counter)  # disabled
panel_6 = Panel(tree)
cluster_3 = Cluster_2(A=number_slider_5, B=box_size)  # -> R, R_2
cluster_4 = Cluster(
    cores=displayer.cors,
    pods=displayer.podsCOORDINATES,
    users=displayer.userPOSITIONSinTIME,
    line_start=displayer.point1,
    line_end=displayer.point2,
    text_xyz=displayer.text_coordiantes,
    scale=cluster_3.R)  # -> cores_2, pods_2, users_2, line, text

# ---- group: Object geometry
# CORES
number_slider_6 = Slider(12, range=0..20)
T = Slider(0, range=0..1)
sph = Sphere(Base=simplify(cluster_4.cores_2), Radius=simplify(number_slider_6))  # disabled
material = CreateMaterial(Diffuse=displayer.cors_colors, Specular=displayer.cors_colors, Emission=displayer.cors_colors, Transparency=T, Shine=0)  # -> simplify(Material)
box_3 = CenterBox(Base=cluster_4.cores_2, X=cluster_3.R_2, Y=cluster_3.R_2, Z=cluster_3.R_2)
preview_2 = CustomPreview(Geometry=simplify(graft(box_3)), Material=simplify(graft(material)))

# ----
division = Division(A=cluster_3.R_2, B=2)
sph_2 = Sphere(Base=cluster_4.users_2, Radius=division)
preview_3 = CustomPreview(Geometry=simplify(graft(sph_2)), Material=simplify(graft(displayer.userCOLORSinTIME)))

# ---- group: User geometry
# USERS
box_4 = CenterBox(Base=cluster_4.pods_2, X=cluster_3.R_2, Y=cluster_3.R_2, Z=cluster_3.R_2)
material_2 = CreateMaterial(Diffuse=displayer.podsCOLORS, Specular=displayer.podsCOLORS, Emission=displayer.podsCOLORS, Transparency=0, Shine=0)  # -> simplify(flatten(Material))
preview_4 = CustomPreview(Geometry=simplify(graft(box_4)), Material=simplify(graft(material_2)))

# ----
# NUMBERS
number_slider_7 = Slider(5, range=0..5)  # disabled
number_slider_8 = Slider(-0.93, range=-1..1)  # disabled
top_down = Slider(-658, range=-700..1500)  # disabled
# LEGEND
number_slider_9 = Slider(35, range=-100..200)  # disabled
panel_7 = Panel("Glypha 65")  # disabled
number_slider_10 = Slider(10, range=10..20)  # disabled
panel_8 = Panel("Glypha 45 Light")  # disabled
number_slider_11 = Slider(14, range=10..20)  # disabled
vec = VectorXYZ(XComponent=number_slider_7, YComponent=0, ZComponent=number_slider_7)  # -> Vector, Length; disabled
lng = ListLength(List=displayer.print_log)  # disabled
number_slider_12 = Slider(500, range=0..1000)  # disabled
series_2 = Series(Start=top_down, Step=number_slider_9, Count=lng)  # disabled
move = Move(Geometry=cluster_4.text, Motion=vec.Vector)  # -> Geometry, Transform; disabled
position = Position(number=number_slider_8, b=series_2)  # disabled
screentext = ScreenOrientedText(
    Text=reverse(graft(displayer.print_log)),
    Font=panel_8,
    Justification=7,
    Location=graft(position),
    SizeFactor=number_slider_11,
    Depth=0,
    Absolute=True)  # disabled
screentext_2 = ScreenOrientedText(
    Text=graft(displayer.text),
    Font=panel_7,
    Justification=5,
    Location=graft(move.Geometry),
    SizeFactor=number_slider_10,
    Depth=number_slider_12,
    Absolute=True)  # disabled
number_slider_13 = Slider(12, range=0..100)  # disabled
pt = ConstructPoint(XCoordinate=0, YCoordinate=0, ZCoordinate=0)  # disabled
swatch = ColourSwatch(SwatchColor=RGBA(255, 255, 255, 107))  # disabled
division_2 = Division(A=number_slider_12, B=2)  # disabled
cir = Circle(Plane=pt, Radius=number_slider_13)  # disabled
mesh = Mesh(cir)  # disabled
screenmesh = ScreenOrientedMesh(Mesh=mesh, Location=move.Geometry, SizeFactor=1, Color=swatch, Depth=division_2, Absolute=True)  # disabled

# ---- group: Step 3
# Select font and fontsize: search for index in fontlist below
number_slider_14 = Slider(21, range=0..100)

# ---- group: Step 2
# How small or big are the cells in the grid?
number_slider_15 = Slider(10, range=0..10, expression="x*2")

# ---- group: STEP 1
# Right click on geometry function. 'Click on Selecte mulitple geometry'. In rhino select upper line first. Than lower line and press enter.
geo = Geometry([<curve referenced from the Rhino model> x2])

# ----
geo_2 = Geometry(<curve referenced from the Rhino model>)
geo_3 = Geometry([<curve referenced from the Rhino model> x2])
geo_4 = Geometry([<curve referenced from the Rhino model> x2])
cluster_5 = Cluster_3(
    C=geo,
    box_scale=cluster_3.R,
    C_2=geo,
    N=number_slider_15,
    S_2=number_slider_14,
    geo_3=geo_3,
    S=number_slider_14,
    geo_2=geo_4,
    geo=geo_2)

# ---- group: STEP 6
# Add cube to geometry container
number_slider_16 = Slider(1.976, range=0..10)
geo_5 = Geometry([<curve referenced from the Rhino model> x12])
previewlw = CustomPreviewLineweights(Geometry=geo_5, Shader=ColourSwatch(SwatchColor=RGB(0, 0, 0)), Thickness=number_slider_16, Absolute=False)

# ----
H_6 = ColourSwatch(SwatchColor=RGB(6, 64, 63))
merge = Merge(
    Data1=ColourSwatch(SwatchColor=RGB(107, 64, 91)),
    Data2=H_6,
    Data3=ColourSwatch(SwatchColor=RGB(235, 181, 19)),
    Data4=ColourSwatch(SwatchColor=RGB(222, 29, 64)),
    Data5=ColourSwatch(SwatchColor=RGB(242, 105, 41)),
    Data6=ColourSwatch(SwatchColor=RGB(63, 161, 166)),
    Data7=ColourSwatch(SwatchColor=RGB(191, 107, 78)),
    Data8=ColourSwatch(SwatchColor=RGB(201, 201, 155)),
    Data9=ColourSwatch(SwatchColor=RGB(59, 54, 61)))

top_down_2 = Slider(261, range=-226..1500)
lng_2 = ListLength(List=simplify(flatten(merge)))
series_3 = Series(Start=top_down_2, Step=Slider(-67, range=-100..200), Count=lng_2)

number_slider_17 = Slider(12, range=0..100)
number_slider_18 = Slider(-0.779, range=-1..1)
# ACTIVITIES
activities_counter = Number(displayer.activities)
position_2 = Position(number=number_slider_18, b=series_3)
number_slider_19 = Slider(27, range=0..50)
ma = MassAddition(Input=flatten(activities_counter))  # -> Result, PartialResults
python_3 = GhPythonScript()  # -> a
# ---------- python_3: Python ----------
a = ['HOUSE ACTIVITY','SLEEP','WORK','SOCIALIZING','SPORTS','SHOPPING','CIVIC','EDUCATION','RELIGION']
# ---------- end python_3 ----------
division_3 = Division(A=activities_counter, B=ma.Result)
screentext_3 = ScreenOrientedText(
    Text=python_3,
    Font="Glypha 65",
    Justification=6,
    Location=position_2,
    SizeFactor=number_slider_17,
    Depth=0,
    Absolute=True)
pt_2 = ConstructPoint(XCoordinate=0, YCoordinate=expr("-x/2", number_slider_19), ZCoordinate=0)
multiplication_2 = Multiplication(A=Slider(139, range=20..150), B=division_3)
addition_2 = Addition(A=Slider(0.05, range=-0.2..0.2), B=number_slider_18)
addition_3 = Addition(A=Slider(0.03, range=-0.2..0.2), B=addition_2)
addition_4 = Addition(A=Slider(0.1, range=-0.2..0.2), B=addition_2)
rectangle = Rectangle(Plane=pt_2, XSize=multiplication_2, YSize=number_slider_19, Radius=0)  # -> Rectangle, Length
position_3 = Position(number=addition_2, b=series_3)
position_4 = Position(number=addition_3, b=series_3)
position_5 = Position(number=addition_4, b=series_3)
python_4 = GhPythonScript(x=activities_counter)  # -> x
# ---------- python_4: Python ----------
__author__ = "filip"
__version__ = "2019.01.25"



x = ' x '+str(int(x))
# ---------- end python_4 ----------
mesh_2 = Mesh(rectangle.Rectangle)
geo_6 = Geometry([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])
screenmesh_2 = ScreenOrientedMesh(Mesh=geo_6, Location=graft(position_3), SizeFactor=Slider(0.748, range=0..1), Color=graft(merge), Depth=0, Absolute=True)
screenmesh_3 = ScreenOrientedMesh(Mesh=mesh_2, Location=position_5, SizeFactor=1, Color=merge, Depth=0, Absolute=True)
screentext_4 = ScreenOrientedText(
    Text=python_4,
    Font="Glypha 65",
    Justification=4,
    Location=position_4,
    SizeFactor=number_slider_17,
    Depth=0,
    Absolute=True)

number_slider_20 = Slider(0.685, range=-1..1)
top_down_3 = Slider(-648, range=-1500..1500)
series_4 = Series(Start=top_down_3, Step=Slider(68, range=-100..200), Count=Slider(4, range=0..10))
# GRID
number_slider_21 = Slider(-0.06, range=-0.2..0.2)
position_6 = Position(number=number_slider_20, b=series_4)  # -> reverse(graft(pt_2))
addition_5 = Addition(A=Slider(-0.06, range=-0.2..0.2), B=number_slider_20)
bang = ExplodeTree(Data=position_6)  # -> Branch0, Branch1, Branch2, Branch3, Branch4, Branch5
position_7 = Position(number=addition_5, b=series_4)  # -> reverse(graft(pt_2))
merge_2 = Merge(Data1="USER", Data2="POD", Data3="CORE POD", Data4="USER'S DIRECTION")  # -> graft(Result)
addition_6 = Addition(A=number_slider_20, B=Slider(0.03, range=-0.2..0.2))
series_5 = Series(Start=addition_6, Step=number_slider_21, Count=2)
number_slider_22 = Slider(13, range=0..100)
position_8 = Position(number=series_5, b=top_down_3)  # -> graft(pt_2)
bang_2 = ExplodeTree(Data=position_8)  # -> Branch0, Branch1
ln = Line(StartPoint=bang_2.Branch0, EndPoint=bang_2.Branch1)
sph_3 = Sphere(Base=bang.Branch0, Radius=number_slider_22)
box_5 = CenterBox(Base=bang.Branch1, X=number_slider_22, Y=number_slider_22, Z=number_slider_22)
col = Colour(H_3)
col_2 = Colour(H_2)
material_3 = CreateMaterial(Diffuse=col, Specular=col, Emission=col, Transparency=0, Shine=0)  # -> simplify(flatten(Material))
material_4 = CreateMaterial(Diffuse=col_2, Specular=col_2, Emission=col_2, Transparency=0, Shine=0)  # -> simplify(flatten(Material))

number_slider_23 = Slider(7, range=0..10)
box_6 = CenterBox(Base=bang.Branch2, X=number_slider_23, Y=number_slider_23, Z=number_slider_23)
cluster_6 = Cluster_5(box=box_6, A=number_slider_23, B=Slider(2.3, range=2..2.3, expression="-x"))

x_2_1 = Slider(5, range=0..50, expression="x*2+1")
div = DivideDomain(Domain=Domain(0, 1), Count=x_2_1)
cull = CullPattern(List=div, CullPattern=[False, True])
subcrv = SubCurve(BaseCurve=graft(ln), Domain=cull)

# ----
# EVALUATION
number_slider_24 = Slider(0.55, range=-1..1)
addition_7 = Addition(A=Slider(0.08, range=-1..1), B=number_slider_24)
addition_8 = Addition(A=number_slider_24, B=Slider(0.31, range=-1..1))
addition_9 = Addition(A=number_slider_24, B=Slider(0.08, range=-1..1))
number_slider_25 = Slider(1.4644, range=0..10)
swatch_2 = ColourSwatch(SwatchColor=RGB(0, 0, 0))
geo_7 = Geometry([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])
geo_8 = Geometry([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])
geo_9 = Geometry([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])
geo_10 = Geometry([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])
geo_11 = Geometry(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)
geo_12 = Geometry([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])

number_slider_26 = Slider(0, range=0..10)
pod_occupany = Number(displayer.pod_occupancy)
data = Data(26.436)
multiplication_3 = Multiplication(A=simplify(pod_occupany), B=Slider(100, range=0..100))  # -> flatten(Result)
division_4 = Division(A=data, B=Slider(100, range=0..100))
pt_3 = ConstructPoint(XCoordinate=number_slider_26, YCoordinate=number_slider_26, ZCoordinate=number_slider_26)
multiplication_4 = Multiplication(A=division_4, B=multiplication_3)
rectangle_2 = Rectangle(Plane=pt_3, XSize=multiplication_4, YSize=[Domain(0, 3), Domain(0, 4.331)], Radius=0)  # -> Rectangle, Length
swatch_3 = ColourSwatch(SwatchColor=RGB(0, 0, 0))
mesh_3 = Mesh(rectangle_2.Rectangle)
geo_13 = Geometry(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)

python_5 = GhPythonScript(u=location_schedual.USERS)  # -> users; inputs u: list
# ---------- python_5: Python ----------
__author__ = "filip"
__version__ = "2019.01.25"



users = str(len(u)) + ' users'
# ---------- end python_5 ----------
distance_commute = Text(displayer.commute_distance)
cummute_time = Text(displayer.commute_time)
time = Text(displayer.time)
merge_3 = Merge(Data1=time, Data2=python_5, Data3=cummute_time, Data4=distance_commute, Data5=" ")  # -> reverse(flatten(Result))
lng_3 = ListLength(List=merge_3)

top_down_4 = Slider(-261, range=-500..1500)
number_slider_27 = Slider(127, range=-100..200)
series_6 = Series(Start=top_down_4, Step=number_slider_27, Count=lng_3)
position_9 = Position(number=addition_7, b=series_6)

series_7 = Series(Start=top_down_4, Step=number_slider_27, Count=Slider(5, range=0..10))
addition_10 = Addition(A=top_down_4, B=Slider(-13, range=-20..20))
position_10 = Position(number=number_slider_24, b=series_7)  # -> reverse(simplify(graft(pt_2)))
position_11 = Position(number=addition_8, b=top_down_4)  # -> simplify(pt_2)
position_12 = Position(number=addition_9, b=addition_10)  # -> simplify(pt_2)
bang_3 = ExplodeTree(Data=position_10)  # -> Branch0, Branch1, Branch2, Branch3, Branch4
screenmesh_4 = ScreenOrientedMesh(Mesh=geo_11, Location=position_11, SizeFactor=number_slider_25, Color=swatch_2, Depth=0, Absolute=True)
screenmesh_5 = ScreenOrientedMesh(Mesh=geo_12, Location=bang_3.Branch0, SizeFactor=Slider(0.5164, range=0..10), Color=swatch_2, Depth=0, Absolute=True)
screenmesh_6 = ScreenOrientedMesh(Mesh=geo_7, Location=bang_3.Branch1, SizeFactor=Slider(1.6677, range=0..10), Color=swatch_2, Depth=0, Absolute=True)
screenmesh_7 = ScreenOrientedMesh(Mesh=geo_8, Location=bang_3.Branch2, SizeFactor=Slider(0.2595, range=0..10), Color=swatch_2, Depth=0, Absolute=True)
screenmesh_8 = ScreenOrientedMesh(Mesh=geo_9, Location=bang_3.Branch3, SizeFactor=number_slider_25, Color=swatch_2, Depth=0, Absolute=True)
screenmesh_9 = ScreenOrientedMesh(Mesh=geo_10, Location=bang_3.Branch4, SizeFactor=number_slider_25, Color=swatch_2, Depth=0, Absolute=True)

screenmesh_10 = ScreenOrientedMesh(Mesh=geo_13, Location=position_12, SizeFactor=Slider(3, range=0..10), Color=swatch_3, Depth=0, Absolute=True)
screenmesh_11 = ScreenOrientedMesh(Mesh=mesh_3, Location=position_12, SizeFactor=Slider(5, range=0..10), Color=swatch_3, Depth=0, Absolute=True)

screentext_5 = ScreenOrientedText(
    Text=merge_3,
    Font="Glypha 65",
    Justification=4,
    Location=position_9,
    SizeFactor=Slider(16, range=0..20),
    Depth=0,
    Absolute=True)

number_slider_28 = Slider(6, range=0..10)
pdecon = Deconstruct(Point=position_12)  # -> XComponent, YComponent, ZComponent
addition_11 = Addition(A=pdecon.ZComponent, B=number_slider_28)
addition_12 = Addition(A=number_slider_28, B=pdecon.XComponent)
join = TextJoin(Text=[multiplication_3, "%"])
pt_4 = ConstructPoint(XCoordinate=addition_12, YCoordinate=pdecon.YComponent, ZCoordinate=addition_11)
screentext_6 = ScreenOrientedText(
    Text=join,
    Font="Glypha 65",
    Justification=7,
    Location=pt_4,
    SizeFactor=Slider(13, range=0..100),
    Color=ColourSwatch(SwatchColor=RGB(255, 255, 255)),
    Depth=0,
    Absolute=True)

screentext_7 = ScreenOrientedText(
    Text=merge_2,
    Font="Glypha 65",
    Justification=6,
    Location=position_7,
    SizeFactor=Slider(14, range=0..20),
    Depth=0,
    Absolute=True)
preview_5 = CustomPreview(Geometry=simplify(graft([sph_3, box_5, cluster_6])), Material=simplify(graft(material_4)))
preview_6 = CustomPreview(Geometry=simplify(graft(cluster_6)), Material=simplify(graft(material_3)))

# ==== cluster Speed
A = ClusterInput()
multiplication = Multiplication(A=A, B=Slider(900, range=0..1000))
B = ClusterInput()
division = Division(A=multiplication, B=B)
R = ClusterOutput(division)

# ==== cluster SAVEFILE
listofnames = ClusterInput()
listofcolours = ClusterInput()
fileaddress = ClusterInput()
list = ClusterInput()
fileaddress_2 = ClusterInput()
list_2 = ClusterInput()
fileaddress_3 = ClusterInput()
list_3 = ClusterInput()
fileaddress_4 = ClusterInput()
save_rgb_names = PythonScript(LISTofNAMES=listofnames, LISTofCOLOURS=listofcolours, fileAddress=fileaddress)  # -> out; inputs LISTofNAMES: list, LISTofCOLOURS: list
# ---------- save_rgb_names: Python ----------
import Rhino as rc


fileName = open(fileAddress, 'w')

for frame in LISTofNAMES:
    fileName.write(frame + ';')
fileName.write('\n')

for frame in LISTofCOLOURS:
    fileName.write(`frame[0]` + ',' + `frame[1]` + ',' + `frame[2]` + ';')
fileName.write('\n')

fileName.close()
# ---------- end save_rgb_names ----------
save_pts = PythonScript(List=list, fileAddress=fileaddress_2)  # -> out; inputs List: list
# ---------- save_pts: Python ----------
import Rhino as rc

fileName = open(fileAddress, 'w')


for frame in List:
    for coordinates in frame:
#        print coordinates
        fileName.write(`coordinates.X` + ',' + `coordinates.Y` + ',' + `coordinates.Z` + ';')
    fileName.write('\n')

fileName.close()
# ---------- end save_pts ----------
sav_pts = PythonScript(List=list_2, fileAddress=fileaddress_3)  # -> out; inputs List: list
# ---------- sav_pts: Python ----------
for frame in List:
    for coordinates in frame:
#        print coordinates
        fileName.write(`coordinates.X` + ',' + `coordinates.Y` + ',' + `coordinates.Z` + ';')
    fileName.write('\n')

fileName.close()
# ---------- end sav_pts ----------
save_rgb = PythonScript(List=list_3, fileAddress=fileaddress_4)  # -> out; inputs List: list
# ---------- save_rgb: Python ----------
import Rhino as rc


fileName = open(fileAddress, 'w')

for frame in List:
    for color in frame:
        print color
        fileName.write(`color[0]` + ',' + `color[1]` + ',' + `color[2]` + ';')
    fileName.write('\n')

fileName.close()
# ---------- end save_rgb ----------
out = ClusterOutput(save_rgb_names)

# ==== cluster Object
A = ClusterInput()
B = ClusterInput()
B_2 = ClusterInput()
inr = Modulus(A=A, B=B)
i = Modulus(A=inr, B=B_2)
R = ClusterOutput(inr)
R_2 = ClusterOutput(i)

# ==== cluster Cluster
text_xyz = ClusterInput()
scale = ClusterInput()
line_start = ClusterInput()
line_end = ClusterInput()
users = ClusterInput()
scale_2 = Number(scale)
cores = ClusterInput()
pods = ClusterInput()
multiplication = Multiplication(LineStart=line_start, B=scale_2)
multiplication_2 = Multiplication(LineEnd=line_end, B=scale_2)
multiplication_3 = Multiplication(Users=users, B=scale_2)
multiplication_4 = Multiplication(Cores=cores, B=scale_2)
multiplication_5 = Multiplication(Pods=pods, B=scale_2)
multiplication_6 = Multiplication(Text=text_xyz, B=scale_2)
ln = Line(StartPoint=multiplication, EndPoint=multiplication_2)
users_2 = ClusterOutput(multiplication_3)
pods_2 = ClusterOutput(multiplication_5)
cores_2 = ClusterOutput(multiplication_4)
text = ClusterOutput(multiplication_6)
line = ClusterOutput(ln)

# ==== cluster Cluster_2
B = ClusterInput()
A = ClusterInput()
division = Division(A=A, B=2)
division_2 = Division(A=Slider(500, range=0..1000), B=B)
multiplication = Multiplication(A=division_2, B=division)
R = ClusterOutput(division_2)
R_2 = ClusterOutput(multiplication)

# ==== cluster Cluster_3
geo = ClusterInput()
geo_2 = ClusterInput()
geo_3 = ClusterInput()
geo_4 = Geometry(geo_2)
C = ClusterInput()
geo_5 = Geometry(geo)
N = ClusterInput()
C_2 = ClusterInput()
geo_6 = Geometry(geo_3)
divide = DivideCurve(Curve=geo_4, Count=N, Kinks=False)  # -> simplify(Points), Tangents, Parameters
len = Length(Curve=C)
divide_2 = DivideCurve(Curve=geo_5, Count=N, Kinks=False)  # -> simplify(Points), Tangents, Parameters
divide_3 = DivideCurve(Curve=C_2, Count=N, Kinks=False)  # -> simplify(Points), Tangents, Parameters
divide_4 = DivideCurve(Curve=geo_6, Count=N, Kinks=False)  # -> simplify(Points), Tangents, Parameters
number_slider = Slider(0, range=0..100)
multiplication = Multiplication(A=Slider(0.5, range=0..1), B=len)
lng = ListLength(List=divide_3.Points)
subtraction = Subtraction(A=lng, B=Slider(1, range=0..1))  # -> flatten(Result)
item = ListItem(List=subtraction, Index=0, Wrap=True)
division = Division(A=multiplication, B=len)
subtraction_2 = Subtraction(A=lng, B=Slider(1, range=0..1))
panel = Panel(divide_3.Points)
panel_2 = Panel(divide.Points)
panel_3 = Panel(divide_4.Points)
multiplication_2 = Multiplication(A=division, B=subtraction_2)  # -> flatten(Result)
item_2 = ListItem(List=multiplication_2, Index=0, Wrap=True)
item_3 = ListItem(List=divide_3.Points, Index=[item_2, item, number_slider], Wrap=True)
bang = ExplodeTree(Data=panel)  # -> Branch0, Branch1
item_4 = ListItem(List=divide_2.Points, Index=[item_2, item, number_slider], Wrap=True)

bang_2 = ExplodeTree(Data=divide_3.Points)  # -> Branch0, Branch1
number_slider_2 = Slider(10, range=0..20)
pdecon = Deconstruct(Point=bang_2.Branch0)  # -> XComponent, YComponent, ZComponent
pdecon_2 = Deconstruct(Point=bang_2.Branch1)  # -> XComponent, YComponent, ZComponent
addition = Addition(A=number_slider_2, B=pdecon.YComponent)
subtraction_3 = Subtraction(A=pdecon_2.XComponent, B=number_slider_2)
pt = ConstructPoint(XCoordinate=pdecon.XComponent, YCoordinate=addition, ZCoordinate=pdecon.ZComponent)
pt_2 = ConstructPoint(XCoordinate=subtraction_3, YCoordinate=pdecon_2.YComponent, ZCoordinate=pdecon_2.ZComponent)
ln = Line(StartPoint=bang_2.Branch1, EndPoint=pt_2)
ln_2 = Line(StartPoint=bang_2.Branch0, EndPoint=pt)

bang_3 = ExplodeTree(Data=item_3)  # -> Branch0, Branch1
number_slider_3 = Slider(20, range=0..20)
pdecon_3 = Deconstruct(Point=bang_3.Branch0)  # -> XComponent, YComponent, ZComponent
pdecon_4 = Deconstruct(Point=bang_3.Branch1)  # -> XComponent, YComponent, ZComponent
subtraction_4 = Subtraction(A=pdecon_4.XComponent, B=number_slider_3)
addition_2 = Addition(A=number_slider_3, B=pdecon_3.YComponent)
pt_3 = ConstructPoint(XCoordinate=pdecon_3.XComponent, YCoordinate=addition_2, ZCoordinate=pdecon_3.ZComponent)
pt_4 = ConstructPoint(XCoordinate=subtraction_4, YCoordinate=pdecon_4.YComponent, ZCoordinate=pdecon_4.ZComponent)
ln_3 = Line(StartPoint=bang_3.Branch0, EndPoint=pt_3)
ln_4 = Line(StartPoint=bang_3.Branch1, EndPoint=pt_4)

bang_4 = ExplodeTree(Data=panel_2)  # -> Branch0, Branch1
bang_5 = ExplodeTree(Data=panel_3)  # -> Branch0, Branch1
bang_6 = ExplodeTree(Data=item_4)  # -> Branch0, Branch1
pdecon_5 = Deconstruct(Point=bang.Branch0)  # -> XComponent, YComponent, ZComponent
pdecon_6 = Deconstruct(Point=bang.Branch1)  # -> XComponent, YComponent, ZComponent
pdecon_7 = Deconstruct(Point=bang_6.Branch0)  # -> XComponent, YComponent, ZComponent
pdecon_8 = Deconstruct(Point=bang_4.Branch0)  # -> XComponent, YComponent, ZComponent
pdecon_9 = Deconstruct(Point=bang_4.Branch1)  # -> XComponent, YComponent, ZComponent
pdecon_10 = Deconstruct(Point=bang_5.Branch0)  # -> XComponent, YComponent, ZComponent
bang_7 = ExplodeTree(Data=divide_3.Points)  # -> Branch0, Branch1
pdecon_11 = Deconstruct(Point=bang_5.Branch1)  # -> XComponent, YComponent, ZComponent
addition_3 = Addition(A=pdecon_7.XComponent, B=Slider(-20, range=-45..20))
addition_4 = Addition(A=Slider(0, range=0..20), B=pdecon_7.YComponent)
pt_5 = ConstructPoint(XCoordinate=addition_3, YCoordinate=addition_4, ZCoordinate=pdecon_7.ZComponent)

pdecon_12 = Deconstruct(Point=[bang_7.Branch0, bang_7.Branch1])  # -> XComponent, YComponent, ZComponent
lng_2 = ListLength(List=pdecon_12.XComponent)
subtraction_5 = Subtraction(A=lng_2, B=Slider(1, range=0..1))
item_5 = ListItem(List=pdecon_12.XComponent, Index=[subtraction_5, Slider(0, range=0..100)], Wrap=True)
item_6 = ListItem(List=item_5, Index=Slider(1, range=0..1), Wrap=True)
item_7 = ListItem(List=item_5, Index=0, Wrap=True)
subtraction_6 = Subtraction(A=item_6, B=item_7)  # -> flatten(Result)

swatch = ColourSwatch(SwatchColor=RGB(235, 242, 238))
number_slider_4 = Slider(1, range=0..1)
ln_5 = Line(StartPoint=bang_6.Branch0, EndPoint=pt_5)
number_slider_5 = Slider(1, range=0..1)
number_slider_6 = Slider(1, range=0..1)
number_slider_7 = Slider(2, range=0..10)
number_slider_8 = Slider(1, range=0..1)
number_slider_9 = Slider(1, range=0..1)
number_slider_10 = Slider(1, range=0..1)
swatch_2 = ColourSwatch(SwatchColor=RGB(0, 0, 0))
swatch_3 = ColourSwatch(SwatchColor=RGB(207, 213, 210))
swatch_4 = ColourSwatch(SwatchColor=RGB(207, 213, 210))
swatch_5 = ColourSwatch(SwatchColor=RGB(207, 213, 210))
swatch_6 = ColourSwatch(SwatchColor=RGB(207, 213, 210))
previewlw = CustomPreviewLineweights(Geometry=[ln_4, ln_3], Shader=swatch_2, Thickness=number_slider_7, Absolute=False)
previewlw_2 = CustomPreviewLineweights(Geometry=ln_5, Shader=ColourSwatch(SwatchColor=RGB(0, 0, 0)), Thickness=number_slider_7, Absolute=False)
previewlw_3 = CustomPreviewLineweights(Geometry=[ln_2, ln], Shader=ColourSwatch(SwatchColor=RGB(0, 0, 0)), Thickness=Slider(1, range=0..10), Absolute=False)
item_8 = ListItem(List=flatten(subtraction_6), Index=0, Wrap=True)
division_2 = Division(A=item_8, B=Slider(2, range=0..10))  # -> flatten(Result)
dom = ConstructDomain(DomainStart=0, DomainEnd=1)
rev = ReverseList(List=subtraction_6)
box_scale = ClusterInput()
ins = InsertItems(List=rev, Item=division_2, Indices=Slider(1, range=0..1), Wrap=True)
item_9 = ListItem(List=subtraction_6, Index=0, Wrap=True)
subtraction_7 = Subtraction(A=pdecon_5.YComponent, B=item_9)
addition_5 = Addition(A=pdecon_6.XComponent, B=item_9)
subtraction_8 = Subtraction(A=pdecon_8.YComponent, B=item_9)
addition_6 = Addition(A=pdecon_9.ZComponent, B=item_9)
subtraction_9 = Subtraction(A=pdecon_10.XComponent, B=item_9)
addition_7 = Addition(A=pdecon_11.ZComponent, B=item_9)
pt_6 = ConstructPoint(XCoordinate=pdecon_5.XComponent, YCoordinate=subtraction_7, ZCoordinate=pdecon_5.ZComponent)
pt_7 = ConstructPoint(XCoordinate=addition_5, YCoordinate=pdecon_6.YComponent, ZCoordinate=pdecon_6.ZComponent)
pt_8 = ConstructPoint(XCoordinate=pdecon_8.XComponent, YCoordinate=subtraction_8, ZCoordinate=pdecon_8.ZComponent)
pt_9 = ConstructPoint(XCoordinate=pdecon_9.XComponent, YCoordinate=pdecon_9.YComponent, ZCoordinate=addition_6)
pt_10 = ConstructPoint(XCoordinate=subtraction_9, YCoordinate=pdecon_10.YComponent, ZCoordinate=pdecon_10.ZComponent)
pt_11 = ConstructPoint(XCoordinate=pdecon_11.XComponent, YCoordinate=pdecon_11.YComponent, ZCoordinate=addition_7)
ln_6 = Line(StartPoint=bang.Branch0, EndPoint=pt_6)
ln_7 = Line(StartPoint=bang.Branch1, EndPoint=pt_7)
ln_8 = Line(StartPoint=bang_4.Branch0, EndPoint=pt_8)
ln_9 = Line(StartPoint=bang_4.Branch1, EndPoint=pt_9)
ln_10 = Line(StartPoint=bang_5.Branch0, EndPoint=pt_10)
ln_11 = Line(StartPoint=bang_5.Branch1, EndPoint=pt_11)
previewlw_4 = CustomPreviewLineweights(
    Geometry=ln_6,
    Shader=ColourSwatch(SwatchColor=RGB(207, 213, 210)),
    Thickness=Slider(0, range=0..10),
    Absolute=Toggle(True))
previewlw_5 = CustomPreviewLineweights(
    Geometry=ln_7,
    Shader=ColourSwatch(SwatchColor=RGB(207, 213, 210)),
    Thickness=Slider(0, range=0..10),
    Absolute=Toggle(True))
previewlw_6 = CustomPreviewLineweights(Geometry=ln_8, Shader=swatch, Thickness=Slider(0, range=0..10), Absolute=Toggle(True))
previewlw_7 = CustomPreviewLineweights(Geometry=ln_9, Shader=swatch, Thickness=Slider(0, range=0..10), Absolute=Toggle(True))
previewlw_8 = CustomPreviewLineweights(Geometry=ln_10, Shader=swatch, Thickness=Slider(0, range=0..10), Absolute=Toggle(True))
previewlw_9 = CustomPreviewLineweights(Geometry=ln_11, Shader=swatch, Thickness=Slider(0, range=0..10), Absolute=Toggle(True))
multiplication_3 = Multiplication(B=2)
division_3 = Division(A=ins, B=box_scale)
dom_2 = ConstructDomain(DomainStart=Slider(1, range=0..1), DomainEnd=Slider(2, range=0..10))
subset = SubList(List=division_3, Domain=dom_2, Wrap=True)  # -> List, Index
S = ClusterInput()
S_2 = ClusterInput()
panel_4 = Panel(subset.List)

bang_8 = ExplodeTree(Data=divide_2.Points)  # -> Branch0, Branch1
pdecon_13 = Deconstruct(Point=bang_8.Branch0)  # -> XComponent, YComponent, ZComponent
addition_8 = Addition(A=Slider(0, range=0..20), B=pdecon_13.YComponent)

addition_9 = Addition(A=pdecon_13.XComponent, B=Slider(-10, range=-45..20))

pt_12 = ConstructPoint(XCoordinate=addition_9, YCoordinate=addition_8, ZCoordinate=pdecon_13.ZComponent)
ln_12 = Line(StartPoint=bang_8.Branch0, EndPoint=pt_12)

previewlw_10 = CustomPreviewLineweights(Geometry=ln_12, Shader=ColourSwatch(SwatchColor=RGB(0, 0, 0)), Thickness=Slider(1, range=0..10), Absolute=False)

end = EndPoints(Curve=ln_5)  # -> Start, End
number_slider_11 = Slider(9, range=0..10)

subset_2 = SubList(List=end.End, Domain=dom, Wrap=True)  # -> List, Index
panel_5 = Panel(subset_2.List)

end_2 = EndPoints(Curve=ln_4)  # -> Start, End
shift = ShiftList(List=end_2.End, Shift=Slider(2, range=0..10), Wrap=True)
pdecon_14 = Deconstruct(Point=shift)  # -> XComponent, YComponent, ZComponent
addition_10 = Addition(A=Slider(8, range=0..100), B=pdecon_14.YComponent)
number_slider_12 = Slider(9, range=0..10)

subtraction_10 = Subtraction(A=pdecon_14.XComponent, B=Slider(5, range=0..10))

pt_13 = ConstructPoint(XCoordinate=subtraction_10, YCoordinate=addition_10, ZCoordinate=pdecon_14.ZComponent)

justified_text = JustifiedText3d(
    Location=pt_13,
    Text=division_3,
    Size=S,
    Color=swatch_2,
    HorizontalAlignment=Slider(2, range=0..10),
    VerticalAlginment=Slider(2, range=0..10),
    Font="Glypha 65",
    UseMeshes=False,
    Bake=False)

end_3 = EndPoints(Curve=ln_3)  # -> Start, End

rev_2 = ReverseList(List=end_3.End)

shift_2 = ShiftList(List=subset_2.List, Shift=Slider(4, range=0..10), Wrap=True)
pdecon_15 = Deconstruct(Point=shift_2)  # -> XComponent, YComponent, ZComponent
addition_11 = Addition(A=Slider(8, range=0..100), B=pdecon_15.YComponent)

subtraction_11 = Subtraction(A=pdecon_15.ZComponent, B=Slider(0, range=0..10))
subtraction_12 = Subtraction(A=pdecon_15.XComponent, B=Slider(5, range=0..10))

pt_14 = ConstructPoint(XCoordinate=subtraction_12, YCoordinate=addition_11, ZCoordinate=subtraction_11)

prot = RotatePlane(Plane=pt_14, Angle=degrees(Slider(0, range=0..360)))
xz = XZPlane(Origin=prot)
panel_6 = Panel(pt_14)
justified_text_2 = JustifiedText3d(
    Location=xz,
    Text=subset.List,
    Size=S,
    Color=swatch_2,
    HorizontalAlignment=Slider(2, range=0..10),
    VerticalAlginment=Slider(1.391, range=0..10),
    Font="Glypha 65",
    UseMeshes=False,
    Bake=False)

shift_3 = ShiftList(List=rev_2, Shift=Slider(7, range=0..10), Wrap=True)
pdecon_16 = Deconstruct(Point=shift_3)  # -> XComponent, YComponent, ZComponent
addition_12 = Addition(A=Slider(8, range=0..100), B=pdecon_16.YComponent)
pt_15 = ConstructPoint(XCoordinate=pdecon_16.XComponent, YCoordinate=addition_12, ZCoordinate=pdecon_16.ZComponent)

prot_2 = RotatePlane(Plane=pt_15, Angle=degrees(Slider(270, range=0..360)))

justified_text_3 = JustifiedText3d(
    Location=prot_2,
    Text=division_3,
    Size=S_2,
    Color=swatch_2,
    HorizontalAlignment=Slider(2, range=0..10),
    VerticalAlginment=Slider(1, range=0..10),
    Font="Glypha 65",
    UseMeshes=False,
    Bake=False)

# ==== cluster Cluster_4
folder_path = ClusterInput()
folder_path_2 = FilePath(folder_path)
file = ClusterInput()
file_2 = ClusterInput()
python = GhPythonScript(folder=folder_path_2, conector="/", file=file)  # -> path
# ---------- python: Python ----------
__author__ = "filip"
__version__ = "2019.01.22"

import rhinoscriptsyntax as rs

path = folder + conector + file
# ---------- end python ----------
python_2 = GhPythonScript(folder=folder_path_2, conector="/", file=file_2)  # -> path; same code as python
names_separator = ClusterInput()
file_3 = ReadFile(File=python, PerLineParse=True)
file_4 = ReadFile(File=python_2, PerLineParse=True)
rules_separator = ClusterInput()
split = TextSplit(Text=file_3, NamesSeparator=names_separator)  # -> simplify(Result)
split_2 = TextSplit(Text=file_4, RulesSeparator=rules_separator)  # -> simplify(Result)
item = ListItem(List=split, Index=0, Wrap=True)  # -> flatten(Item)
item_2 = ListItem(List=split, Index=Slider(1, range=0..1), Wrap=True)  # -> flatten(Item)
rules = ClusterOutput(split_2)
second_names = Text(item_2)
first_names = Text(item)
second_names_2 = ClusterOutput(second_names)
first_names_2 = ClusterOutput(first_names)

# ==== cluster Position
number_slider = Slider(552, range=0..1000)
sqrt_2 = SquareRoot(Value=2)
multiplication = Multiplication(A=sqrt_2, B=number_slider)
vec = VectorXYZ(XComponent=multiplication, YComponent=expr("-x", number_slider), ZComponent=0)  # -> Vector, Length
number = ClusterInput()
number_slider_2 = Slider(250, range=0..1000)
left = Vector(expr("-x", vec.Vector))
devec = DeconstructVector(Vector=vec.Vector)  # -> XComponent, YComponent, ZComponent
number_2 = Number(number)
right = Vector(vec.Vector)
b = ClusterInput()
multiplication_2 = Multiplication(A=number_2, B=devec.XComponent)
multiplication_3 = Multiplication(A=number_2, B=devec.YComponent)
addition = Addition(A=multiplication_3, B=number_slider_2)
addition_2 = Addition(A=number_slider_2, V=b)
addition_3 = Addition(A=multiplication_2, B=number_slider_2)
pt = ConstructPoint(XCoordinate=addition_3, YCoordinate=addition, ZCoordinate=addition_2)
pt_2 = ClusterOutput(pt)

# ==== cluster Cluster_5
box = ClusterInput()
A = ClusterInput()
B = ClusterInput()
box_2 = Box(box)
multiplication = Multiplication(A=A, B=B)
vec = VectorXYZ(XComponent=multiplication, YComponent=0, ZComponent=0)  # -> Vector, Length
vec_2 = VectorXYZ(XComponent=multiplication, YComponent=multiplication, ZComponent=0)  # -> Vector, Length
vec_3 = VectorXYZ(XComponent=0, YComponent=multiplication, ZComponent=0)  # -> Vector, Length
move = Move(Geometry=box_2, Motion=[vec.Vector, vec_2.Vector, vec_3.Vector])  # -> Geometry, Transform
vec_4 = VectorXYZ(XComponent=0, YComponent=0, ZComponent=expr("-x", multiplication))  # -> Vector, Length
move_2 = Move(Geometry=[move.Geometry, box_2], Motion=vec_4.Vector)  # -> Geometry, Transform
box_3 = Box([move_2.Geometry, move.Geometry, box_2])
box_4 = ClusterOutput(box_3)
